# Grasshopper definition RhinoGPT_evaluation.gh (Grasshopper 1.0.8)
# plug-ins: Human, Pancake

# ---- group: Inputs
launch = Button()
go = BooleanToggle(True)
reset = BooleanToggle(True)
finishedcalled = BooleanToggle(False)
value_list = ValueList({"ChatGPT", "Anthropic", "Mistral", "Gemini", "DeepSeek"}, selected="ChatGPT")

# ----
# Start
refresh = Button()
start = BooleanToggle(False)

# ----
# Testing (Half-Automated)
# Evaluation
# LLM
# Important
# Save
# VisualInspection
next = Button()
allow_generation = BooleanToggle(False)
visual_check = Button()
visual_improve = BooleanToggle(False)
allow_evaluation = BooleanToggle(False)
button = Button()

json_reader = Python3Script(allow_run=start, evaluation_done=next, refresh=refresh)  # -> geometry_out, model_out, agent_out, run_done
# ---------- json_reader: Python ----------
if allow_run:
    import json

    # Full path to your evaluation task file
    json_path = r"C:\Users\natha\OneDrive\Desktop\OneDrive - ETH Zurich\GitHub\text-to-design-clean\CodeEnvironment\evaluation_task_o3.json"
    
    # State initialization
    if 'state' not in globals():
        state = {
            "task_index": 0,
            "tasks": [],
            "running": False
        }
    if refresh:
        state["running"] = False
        

    # Start trigger: load tasks from JSON
    if not state["running"]:
        try:
            with open(json_path, "r", encoding="utf-8") as f:
                state["tasks"] = json.load(f)["tasks"]
            state["task_index"] = 0
            state["running"] = True
        except Exception as e:
            raise Exception(f"Failed to load JSON: {e}")

    # Default outputs
    geometry_out = None
    model_out = None
    agent_out = None
    run_done = False

    if evaluation_done:
        state["task_index"] += 1
        

    # Main task control
    if state["running"] and state["task_index"] < len(state["tasks"]):
        task = state["tasks"][state["task_index"]]
        geometry_out = task["geometry"]
        model_out = task["model"]
        agent_out = task["agent"]

    elif state["running"]:
        run_done = True
# ---------- end json_reader ----------
panel = Panel(json_reader.run_done)
panel_2 = Panel(json_reader.geometry_out)
panel_3 = Panel(json_reader.model_out)
panel_4 = Panel(json_reader.agent_out)

# ---- group: Output Directory
# Output directory is automatically created
panel_5 = Panel("\destination.txt")

# ----
base_destination_path = Panel("C:\Users\natha\OneDrive\Desktop\OneDrive - ETH Zurich\GitHub\text-to-design-clean\Evaluation\log")

# ---- group: LLM Interaction
# Makes sure that code does not run during development
directory_path = Panel("C:\Users\natha\OneDrive\Desktop\OneDrive - ETH Zurich\GitHub\text-to-design-clean\CodeEnvironment")
gpt = Script(
    allow_run=allow_generation,
    launch=launch,
    go=go,
    reset=reset,
    AgentMode=json_reader.agent_out,
    FinishedCalled=finishedcalled,
    GPT=value_list,
    DeepSeek_model=json_reader.model_out,
    Gemini_model=json_reader.model_out,
    Anthropic_model=json_reader.model_out,
    OpenAI_model=json_reader.model_out,
    prompt_name=json_reader.geometry_out,
    new_folder_name="TestPrompts",
    base_destination_path=base_destination_path,
    path=directory_path)  # -> gh_terminal_path, f, visualInspection_trigger, interaction, change, check, agent
# ---------- gpt: Python ----------
# #Uncomment in third-party IDE
# allow_run = True
if allow_run and prompt_name:


    # -----------------------*** IMPORT MODULES ***-----------------------

    ## Uncomment in GH (rhinoscriptsyntax can only run in GH python component)
    import rhinoscriptsyntax as rs
    
    
    # Google Gemini
    
    import vertexai
    from vertexai.generative_models import GenerationConfig, GenerativeModel, Image, Part, Content, FunctionDeclaration, Tool
    from vertexai.generative_models._generative_models import ToolConfig
    
    #path to service acc json
    os.environ["GOOGLE_APPLICATION_CREDENTIALS"] = ""

    # GENERAL MODULES
    import logging
    import os
    import shutil
    import sys
    import json_repair
    import json
    import glob
    import time
    import re
    from typing import List
    from dataclasses import dataclass
    from typing import Optional, Any
    from pathlib import Path
    import sys

    # LLM MODULES
    
    # Claude
    from anthropic import Anthropic

    # ChatGPT
    import openai as openai_old
    from openai import OpenAI as DeepSeekAI
    
    # Mistral
    from mistralai.client import MistralClient
    from mistralai.models.chat_completion import ChatMessage

    # Meta LLaMa (potentially)
  


    # -----------------------*** VARIABLE AND PATH INITILIZATION ***-----------------------

    # # Uncomment if editing in third-party IDE, otherwise inputs directly from input block in GH
    # go = True
    # reset = False
    # FinishedCalled = False
    # Allow_askback = False

    # GPT = "ChatGPT"
    # OpenAI_model = "gpt-4o"
    # prompt_name ="toycar_a"

    # # replace path with location of CodeEnvironment folder. CodeEnvironment contains:
    #     # functions folder: block.json, cylinder.json, finished.json, force.json, CreateCode.json
    #     # temp folder: instances of functions (JSON files), crash_file.txt, terminal_output.txt
    #     # keys for ChatGP (key.txt), Anthropic, and Mistral
    #     # geometry_creation.py: module containing function defintions for functions that parse JSON object instances into rhinoscriptsyntax 
    #         # functions, imported into CreateGeometries python block in GH (Note: brings up the question of why that is not done in GPT 
    #         # python block as well.
    #     # log.json: contains log of conversation with LLM, including the system definition, prompt, and function instantiations
    #     # task.json: contains the descriptions of the system and each agent workflow (askBack, stepPlanning, visualInspection)
    #     # test_prompts.json: contains text prompts
        
    # path = r"P:\01_Research_projects\2023_DNT_LLM_in_Engineering_Applications\04_Paper\Code\Grasshopper\CodeEnvironment"

    # # replace base_destination_path with location of folder where results will be saved. These include:
    #     # temp folder
    #     # log.json
    #     # STL file (if exported)

    # base_destination_path = r"P:\01_Research_projects\2023_DNT_LLM_in_Engineering_Applications\04_Paper\Experiments\Different GPT\ChatGPT"

    ## Uncomment until here

    # number attached to end of new_folder_name will be increased automatically
    new_folder_name= "TestPrompts"

    logfile = "log.json"
    taskfile = "task.json"

    debug = True
    change = False
    click = False
    click_filename = "Click"

    # Set LLM functions relative path 
    directory_path = "functions/"  # Adjust the path to your functions directory

    current_dir = os.getcwd()
    if current_dir not in sys.path:
        sys.path.append(current_dir)

    os.chdir(path)

    sys.path.append

    # Create temp folder
    folder = "temp"
    # Relative terminal path
    terminal_path = os.path.join(folder, "terminal_output.txt")
    # Absolute terminal path
    gh_terminal_path = os.path.join(path, terminal_path)
   
    text = [] #Does not appear to be necessary, consider removing

    # All inputs and responses are appended to messages and periodically logged onto log.json
    messages = []

    # -----------------------*** FUNCTIONS ***-----------------------
    # Note: Should be found in a separate module and then imported with something like this:
    # from gpt_functions import *, but currently many function definitions depend on variables in the main program 
    # that are not passed to the function definitons, so simply copy and pasting these functions onto a separarte
    # module is complicated


    # LOGGING
    class StreamToLogger:
        """
        Custom stream object that redirects writes to a logger instance.
        """
        def __init__(self, logger, log_level=logging.INFO):
            self.logger = logger
            self.log_level = log_level
            self.linebuf = ''

        def write(self, buf):
            for line in buf.rstrip().splitlines():
                self.logger.log(self.log_level, line.rstrip())

        def flush(self):
            pass

    # Set up logging
    logging.basicConfig(filename=terminal_path,
                        filemode='w',
                        format='%(message)s',
                        level=logging.INFO)
    logger = logging.getLogger()

    # Redirect stdout to the logging handler
    sys.stdout = StreamToLogger(logger, logging.INFO)

    def logger(messages, logfile):
        with open(logfile, "w", encoding="utf-8") as tf:
            # Use the default parameter to specify your conversion function
            json.dump(messages, tf, default=default_converter, ensure_ascii=False)

    # FORMATTING AND DATA TRANSFER
    def custom_serializer(obj):
        if hasattr(obj, 'fields'):
            # Assumes fields is a dictionary of key-value pairs
            return {k: custom_serializer(v) for k, v in obj.fields.items()}
        elif hasattr(obj, 'number_value'):
            # Direct conversion of number_value
            return obj.number_value
        elif hasattr(obj, 'struct_value'):
            # Recursive handling of struct_value
            return custom_serializer(obj.struct_value)
        elif hasattr(obj, 'list_value'):
            # Handle list values
            return [custom_serializer(item) for item in obj.list_value]
        else:
            # Check for other types that json can serialize directly
            try:
                json.dumps(obj)
                return obj
            except TypeError:
                # Final catch for any types that are still not handled
                return str(obj)

    def parse_list(arguments):
        # Filter out non-list values and empty lists
        list_values = [v for v in arguments.values() if isinstance(v, list)]
        print("--------------------------Parsing Function Arguments -------------------------------")
        if not list_values:
            # If there are no lists, return original arguments
            print("No lists found in the arguments.")
            return arguments
        
        # Determine the maximum length among all non-empty lists
        max_length = max(len(v) for v in list_values)

        # Ensure boolean lists remain as lists of booleans
        for key, value in arguments.items():
            if isinstance(value, list) and all(isinstance(item, bool) for item in value):
                print(f"Ensuring boolean list for key '{key}' remains as booleans.")
                value[:] = [bool(item) for item in value]
        
        # Iterate through each key and update lists as needed
        for key, value in arguments.items():
            if isinstance(value, list):
                current_length = len(value)
                if current_length < max_length:
                    if current_length == 0:
                        value.extend([0] * max_length)
                        print(f"\033[91mFilled '{key}' with {max_length} zeros.\033[0m")
                    else:
                        last_element = value[-1]
                        additional_elements = max_length - current_length
                        value.extend([last_element] * additional_elements)
                        print(f"Added {additional_elements} elements with value '{last_element}' to '{key}'.")
                elif current_length == 0:
                    value.extend([0] * max_length)
                    print(f"\033[91mFilled '{key}' with {max_length} zeros.\033[0m")
        
        return arguments

    def create_unique_folder(base_path, base_name):
        # Start with index 1 since the first folder should be base_name_1
        index = 1
        while True:
            new_folder_name = f"{base_name}_{index}"
            new_folder_path = os.path.join(base_path, new_folder_name)
            if not os.path.exists(new_folder_path):
                os.makedirs(new_folder_path)
                print(f"Created directory: {new_folder_path}")
                return new_folder_path
            index += 1

    def copy_files_and_folders(base_destination, folder_name, destination = None):
        # Create a unique folder inside the destination
        if destination is None:
            destination = create_unique_folder(base_destination, folder_name)
        
        # List of items to copy
        items_to_copy = ['temp', 'log.json']
        
        for item in items_to_copy:
            # Construct source path
            source_path = os.path.join(os.getcwd(), item)
            # Construct destination path within the newly created unique folder
            dest_path = os.path.join(destination, item)
            
            # Check if the item exists before attempting to copy
            if os.path.exists(source_path):
                if os.path.isdir(source_path):
                    # Copy the directory recursively
                    shutil.copytree(source_path, dest_path, dirs_exist_ok=True) 
                    print(f"Copied {item} to {destination}")
                else:
                    # Copy the file
                    shutil.copy(source_path, dest_path)
                    print(f"Copied {item} to {destination}")
            else:
                print(f"{item} does not exist in the source directory.")
        return destination

    def repair_python_to_JSON(json_like_string):
        # Temporarily replace escaped single quotes to avoid conversion
        temp_placeholder = re.sub(r"\\'", "TEMP_SINGLE_QUOTE", json_like_string)
        
        # Convert single quotes to double quotes
        repaired_string = temp_placeholder.replace("'", '"')
        
        # Revert temporarily replaced escaped single quotes back to original
        repaired_string = re.sub(r"TEMP_SINGLE_QUOTE", "\\'", repaired_string)
        
        # Replace Python's True and False with JSON's true and false
        repaired_string = re.sub(r"\bTrue\b", "true", repaired_string)
        repaired_string = re.sub(r"\bFalse\b", "false", repaired_string)
        
        # Replace Python's None with JSON's null
        repaired_string = re.sub(r"\bNone\b", "null", repaired_string)
        
        return repaired_string

    def sanitize_subtraction_field(directory: str) -> None:
        """
        Sanitizes the 'subtraction' field in all .json files within the given directory.
        Args:
        - directory (str): The path to the directory containing the .json files to be sanitized.
        """
        # List all JSON files in the directory
        for filename in os.listdir(directory):
            if filename.endswith(".json"):
                file_path = os.path.join(directory, filename)
                with open(file_path, "r", encoding="utf-8") as file:
                    print(f"Sanitizing file {filename}")
                    try:
                        data = json.load(file)
                        # Check if "subtraction" field exists and needs sanitization
                        if "subtraction" in data and isinstance(data["subtraction"], List):
                            sanitized_subtraction = sanitize_subtraction_list(data["subtraction"])
                            data["subtraction"] = sanitized_subtraction
                            # Save the modified data back to the file
                            with open(file_path, "w", encoding="utf-8") as outfile:
                                json.dump(data, outfile, ensure_ascii=False)
                    except json.JSONDecodeError:
                        print(f"Skipping file {filename} due to JSON decoding error.")

    def sanitize_subtraction_list(subtraction_list: List[str]) -> List[str]:
        """
        Converts a list of stringified boolean lists into a list of string booleans.
        Args:
        - subtraction_list (List[str]): The original list of stringified boolean lists.
        Returns:
        - List[str]: A sanitized list of string booleans.
        """
        sanitized_list = []
        # Regular expression to find all boolean values in the string
        boolean_pattern = re.compile(r"True|False", re.IGNORECASE)
        for item in subtraction_list:
            # Find all boolean values in the current string
            bool_strings = boolean_pattern.findall(item)
            # Convert boolean strings to their lowercase string representations and extend the sanitized list
            sanitized_list.extend([bs.lower() for bs in bool_strings])
        return sanitized_list

    def default_converter(o):
        try:
            # Attempt to use the object's own method to convert it to a serializable form, if available
            return o.__dict__
        except AttributeError:
            # If it doesn't work, just convert the object to a string
            return str(o)

    def crash_file_tracker(variable):
        crashfile = str(variable)
        with open(os.path.join(os.getcwd(), folder, "crash_file.txt"), "w", encoding="utf-8") as tf:
            tf.write(crashfile)

    def store_and_merge(new_args, function_name):
        # Path to the JSON file
        file_path = os.path.join(os.getcwd(), folder, f"{function_name}.json")
        
        # Check if the file exists and read existing data; if not, initialize an empty dict
        if os.path.exists(file_path):
            with open(file_path, "r", encoding="utf-8") as tf:
                try:
                    existing_data = json.load(tf)
                    # Ensure existing_data is a dictionary
                    if not isinstance(existing_data, dict):
                        existing_data = {}
                except json.JSONDecodeError:  # In case the file is empty or contains invalid JSON
                    existing_data = {}
        else:
            existing_data = {}
        
        # Merge the new arguments into the existing data
        for key, value in new_args.items():
            if key in existing_data:
                # Assume the value is a list and append the new value(s)
                if isinstance(value, list):
                    existing_data[key].extend(value)
                else:
                    # If the existing or new value is not a list, make it a list and append
                    if not isinstance(existing_data[key], list):
                        existing_data[key] = [existing_data[key]]
                    existing_data[key].append(value)
            else:
                # If the key does not exist in the existing data, add it
                existing_data[key] = value if isinstance(value, list) else [value]
        
        # Store the merged data
        with open(file_path, "w", encoding="utf-8") as tf:
            json.dump(existing_data, tf, ensure_ascii=False)

    def normalize_booleans_in_string(json_str):
        # Find all occurrences of True/False and replace them with true/false
        if "True" in json_str or "False" in json_str:
            print("\033[91mFound and modifying booleans in JSON string.\033[0m")
        json_str = json_str.replace("True", "true").replace("False", "false")
        return json_str

    def serialize_proto_value(value):
        """Converts Protocol Buffer RepeatedComposite or other non-serializable values to Python native types."""
        if hasattr(value, 'extend'):  # Check if it behaves like a list
            return [v for v in value]
        else:
            return value

    def load_prompts(prompt_name):
        # Dynamically loading and printing all variables
        try:
            print("Loading Test-Prompts")
            with open('test_prompts.json', 'r', encoding='utf-8') as json_file:
                data = json.load(json_file)
            return data.get(prompt_name)
        except:
            print("\033[91mError during loading of test prompts\033[0m")
            return None


    @dataclass
    class FunctionCall:
        name: Optional[str] = None
        arguments: Optional[str] = None  # Arguments as a JSON string or None

    @dataclass
    class ChatCompletionMessage:
        role: str
        function_call: Optional[FunctionCall] = None
        content: Optional[str] = None
        tool_calls: Optional[Any] = None 

    # CREATE CODE AND TOOLS FROM LLM RESPONSE
    def create_code(PythonCode):
        # Preprocess the PythonCode to indent it correctly
        indented_code = "    " + PythonCode.replace('\n', '\n    ')
        # Construct the wrapped code with the pre-indented Python code
        wrapped_code = "def temp_function():\n" + indented_code + "\n    return locals()"
        try:
            local_env = {}
            exec(wrapped_code, {}, local_env)  # Execute the wrapped function definition
            result = local_env['temp_function']()  # Call the newly defined function and get the return value
            # Assuming the result is a dictionary of values you want to return
            return str(result)
        except Exception as e:
            return f"the function failed and returned: {str(e)}"

    def create_tool_from_json(directory_path):
        function_declarations = []
        for function_file in glob.glob(os.path.join(directory_path, "*.json")):
            with open(function_file, "r") as file:
                function_definition = json.load(file)
                
                # Remove the 'default' keys from parameters if they exist
                for param in function_definition['parameters']['properties'].values():
                    if 'default' in param:
                        del param['default']
                
                function_declaration = FunctionDeclaration(
                    name=function_definition["name"],
                    description=function_definition["description"],
                    parameters=function_definition["parameters"]
                )
                function_declarations.append(function_declaration)
        
        return Tool(function_declarations=function_declarations)

    # CLICKING (NOT YET FUNCTIONING)
    def return_click_point():
        #Store Info
        
        click_file_path = os.path.join(os.getcwd(), folder, f"{click_filename}.txt")
        if os.path.exists(click_file_path):
            with open(click_file_path, 'r') as file:
                click_data_loaded = json.load(file)    

        point_coords = click_data_loaded['point']
        vector_coords = click_data_loaded['vector']
        Click_Point = rs.CreatePoint(round(point_coords['x'], 2), round(point_coords['y'],2 ), round( point_coords['z'],2 ))
        Click_Normal = rs.CreateVector(vector_coords['x'], vector_coords['y'], vector_coords['z'])
        Click_string = f"The user clicked at the Position: {Click_Point[0]},{Click_Point[1]},{Click_Point[2]} " \
            f"with the normal facing in the direction: {Click_Normal[0]},{Click_Normal[1]},{Click_Normal[2]}"
        return Click_string


    # FUNCTIONS DEPENDENT ON LLM PROVIDER
    def toChatGPT(message): # appears to only be used in toGemini
        if debug == True:
            print("message to ChatGPT: ")
            print(message)
        function_name = None
        args_json = None

        # Check if there's a function call in the message
        if hasattr(message.parts[0], 'function_call') and message.parts[0].function_call:
            function_name = message.parts[0].function_call.name
            # Serialize arguments using the custom serializer
            args_dict = {key: serialize_proto_value(value) for key, value in message.parts[0].function_call.args.items()}
            args_json = json.dumps(args_dict, ensure_ascii=False, default=custom_serializer)

        # Safely check if there's text in the message
        message_text = None
        try:
            if message.parts[0].text:  # This line may raise ValueError if text is not present
                message_text = message.parts[0].text
        except AttributeError:
            pass  # No text in the message part, handle as needed

        # Create the FunctionCall object if a function call exists
        function_call = FunctionCall(name=function_name, arguments=args_json) if function_name and args_json else None

        # Create the ChatCompletionMessage object
        chat_message = ChatCompletionMessage(role='model', function_call=function_call, content=message_text)

        return chat_message


    def toGemini(full_message): 
        last_message = full_message[-1]
        
        if last_message["role"] not in ["user", "model"]:
            raise ValueError(f"Invalid Gemini role: {last_message['role']}")

        return Content(
            role=last_message["role"],
            parts=[Part.from_text(last_message["content"])])


    
    def _ds_normalize(msg):
        """
        Wandelt DeepSeek-Assistant-Objekt in ein Dict
        und füllt für Logs den content mit den Argumenten.
        """
        if isinstance(msg, dict):
            return msg                       # schon normalisiert

        out = {"role": msg.role}

        # Tool-Call vorhanden?
        if getattr(msg, "tool_calls", None):
            fc = msg.tool_calls[0].function
            out["function_call"] = {
                "name": fc.name,
                "arguments": json.dumps(fc.arguments or {}, ensure_ascii=False)
            }

            # ► Nur fürs **Log** – zeigt Parameter statt leerem String
            out["content"] = str(fc.arguments)         

        else:
            # normaler Text-Assistant
            out["content"] = str(msg.content or "")

        return out

    def RequestFunction(assistant_message):
        '''
        Get function for function implementation from unique LLM response assistant_message
        '''

        if GPT == "Anthropic":
            class FunctionExtractor:
                def __init__(self, assistant_message):
                    # Extracting the ToolUseBlock from the assistant message
                    
                    try:
                        # Find the tool_use block in the content
                        for content_block in assistant_message:
                            if hasattr(content_block, 'type') and content_block.type == 'tool_use':
                                self._name = content_block.name
                                self._arguments = content_block.input
                                self._id = content_block.id
                                break
                        else:
                            # No tool_use block found
                            print("No tool_use block found in assistant message")
                            self._name = ''
                            self._arguments = {}
                            self._id = ''
                    except Exception as e:
                        print(f"Error During Reading of Function Call: {e}")
                        self._name = ''
                        self._arguments = {}
                        self._id = ''

                @property
                def name(self):
                    return self._name

                @property
                def arguments(self):
                    return self._arguments
                
                @property
                def id(self):
                    return self._id

            # Creating and returning an instance of FunctionExtractor with the provided assistant message
            return FunctionExtractor(assistant_message)   

        if GPT == "Mistral":
            return assistant_message.tool_calls[0].function

        if GPT == "Gemini":
            return assistant_message.function_call

        if GPT == "ChatGPT":      
            return assistant_message.function_call
        
        if GPT == "DeepSeek":
            return assistant_message.tool_calls[0].function if getattr(assistant_message, "tool_calls", None) else None


        
    def append_function(assistant_message, answer = "", new_args = ""):
        '''
        Appends function implementation to messages
        '''
        returned_function_call = RequestFunction(assistant_message)
        
        if GPT == "DeepSeek":
            if returned_function_call is None:
                # Kein Function-Call → nur Text übernehmen und fertig
                text_only = RequestText(assistant_message) or ""
                ds_append(messages, assistant_message) if GPT == "DeepSeek" else \
                    messages.append({"role": "assistant", "content": text_only})
                return messages

            function_name = returned_function_call.name or ""

        else:
            function_name = returned_function_call.name


        if answer == "":
            content_message = "successfully created " + function_name + " object. Call now the next function!"
            print("generated answer: " + content_message)
        else:
            print("answered with: " + answer)
            content_message = answer

        if GPT == "Mistral":
            messages.append(assistant_message)
            messages.append(ChatMessage(role="tool", name=str(function_name), content=content_message))
            return messages
        
        elif GPT == "Gemini":
            messages.append({"role":"user","content": "Execute now the next function call. If you already executed all functions, call the finished function"})
            return messages
        
        elif GPT == "ChatGPT":
            messages.append({"role": "assistant", "function_call": {"name": str(function_name), "arguments": str(new_args)}})
            messages.append({"role": "user","content": content_message})
            #messages.append({"role":"user","content": "Execute now the next function call. If you already executed all functions, call the finished function"})
            return messages
        
        elif GPT == "DeepSeek":
            # Assistant-Nachricht (tool_call) anhängen
            ds_append(messages, assistant_message)

            # Erfolgstext nur einmal anfügen
            if not (
                messages
                and messages[-1]["role"] == "user"
                and messages[-1]["content"] == content_message
            ):
                messages.append({"role": "user", "content": content_message})

            return messages

            
        elif GPT == "Anthropic":
            messages.append({"role": "assistant", "content": assistant_message})
            id = returned_function_call.id
            
            messages.append({
                "role": "user",
                "content": [
                    {
                        "type": "tool_result", 
                        "tool_use_id": id, 
                        "content": content_message
                    }
                ]
            })
            return messages        

        else:
            print("Error, no GPT defined")

    def RequestText(assistant_message):
        '''
        Get function for content from unique LLM response assistant_message
        '''
        if GPT == "Mistral":
            try:
                return assistant_message.content
            except:
                print("Error During Reading of Answer")
                return None

        if GPT == "Gemini":
            try:
                return assistant_message.content
            except:
                print("Error During Reading of Answer")
                return None

        if GPT == "ChatGPT":      
            try:
                return assistant_message.content
            except:
                print("Error During Reading of Answer")
                return None
        
        if GPT == "DeepSeek":      
            try:
                return assistant_message.content
            except:
                print("Error During Reading of Answer")
                return None

        if GPT == "Anthropic":
            try:
                # Find the text block in the content
                for content_block in assistant_message:
                    if hasattr(content_block, 'type') and content_block.type == 'text':
                        return content_block.text
                return None
            except:
                print("Error During Reading of Answer")
                return None


    # REQUESTGPT
    # Define functions used to interact with each LLM, depends on the provider. 
    # Note that here, unlike with other function definitions, the "if" condition is placed _before_
    # the definition rather than having it inside
    if GPT == "ChatGPT":
        crash_file_tracker(messages)

        def RequestGPT(messages, tool_call = True, enforce = False):
            response = openai_old.chat.completions.create(
                model= OpenAI_model, # GPT 4: gpt-4-0613 GPT 4 Turbo: gpt-4-0125-preview GPT-4o : gpt-4o-2024-05-13 OpenAI_model "o3"
                messages=messages,
                functions=functions
                #temperature=0.2
            )
            crash_file_tracker(response)
            if debug == True:
                print("ChatGPT Answer: ")
                print(response.choices[0].message)
            return response.choices[0].message

    if GPT == "DeepSeek":
        def RequestGPT(messages, tool_call=True, enforce=False):
            crash_file_tracker(messages)

            if not tool_call:
                tool_choice = "none"
            else:
                tool_choice = "auto"

            response = DeepSeek_client.chat.completions.create(
                model=DeepSeek_model,
                messages=messages,
                tools=[   # statt functions=
                    {"type": "function", "function": fn_def} for fn_def in functions
                ],
                tool_choice=tool_choice,
            )


            crash_file_tracker(response)
            if debug:
                print("DeepSeek Answer: ")
                print(response.choices[0].message)
            return response.choices[0].message

        def ds_append(messages, assistant_msg):
            messages.append(_ds_normalize(assistant_msg))
      
    if GPT == "Anthropic":
        def RequestGPT(messages, tool_call=True, enforce=False):
            if tool_call:
                response = client.messages.create(
                    model=model,
                    max_tokens=4092,
                    messages=messages,
                    tools=functions
                )
                print("Anthropic Answer: ")
                print(response.content)
                return response.content
            else:
                response = client.messages.create(
                    model=model,
                    max_tokens=4092,
                    messages=messages
                )
                print("Anthropic Answer: ")
                print(response.content)
                return response.content


    if GPT == "Mistral":

        def RequestGPT(messages, tool_call = True, enforce = False):
            crash_file_tracker(messages)
            client = MistralClient(api_key=api_key)
            if tool_call:
                if enforce:
                    tool_choice = "any"
                else:
                    tool_choice = "auto"
                response = client.chat(
                    model=model,
                    messages=messages,
                    tools=functions,
                    tool_choice=tool_choice)
            else:
                response = client.chat(
                    model=model,
                    tools=functions,
                    tool_choice="none",
                    messages=messages)
                
            if debug == True:
                print("Mistral Answer: ")
                print(response.choices[0].message)
            return response.choices[0].message

    if GPT == "Gemini":
        def RequestGPT(messages, tool_call = True, enforce = False):
            #Gemini WRAPPER:
            global Gemini_ChatHistory
            global response
            global last_message
            last_message = toGemini(messages)
            print("User Message: ")
            print(last_message)
            crash_file_tracker(last_message)


            if debug == True:
                print("Gemini Chat History: ")
                print(Gemini_ChatHistory)

            if tool_call:
                tool_config = ToolConfig(
                    function_calling_config=ToolConfig.FunctionCallingConfig(
                        mode=ToolConfig.FunctionCallingConfig.Mode.AUTO
                ))

                model = GenerativeModel(model_name=Gemini_model,
                                        tools = [geometry_tool],
                                        tool_config=tool_config,
                                        generation_config={"temperature": 0.2})
            else:
                tool_config = ToolConfig(
                    function_calling_config=ToolConfig.FunctionCallingConfig(
                        mode=ToolConfig.FunctionCallingConfig.Mode.AUTO
                ))            
                model = GenerativeModel(model_name=Gemini_model,
                                        tools = [geometry_tool],
                                        tool_config=tool_config,                                    
                                        generation_config={"temperature": 0.2})
                
            chat = model.start_chat(history = Gemini_ChatHistory)
            crash_file_tracker(str(Gemini_ChatHistory) + str(last_message))
            response = chat.send_message(last_message)

            Gemini_ChatHistory = chat.history

            print("Gemini Answer: ")
            crash_file_tracker(response.candidates[0].content)
            print(response.candidates[0].content)

            return toChatGPT(response.candidates[0].content)


    # -----------------------*** AGENT FUNCTIONS ***-----------------------
    def Agent1(user_input, instruction, messages, again):
        '''
        This agent enables the LLM to engage in dialogue with the user to solicit additional 
        information if it recognizes that the user prompts might lack clarity or completeness
        -Click functionality is not yet in operation
        -Loop allows the LLM to converse with user until it sends a TERMINATE message
        Args:
        -user_input:
        -messages: expandable log of conversation with LLM
        Return:
        -messages: updated log of conversation with LLM, includes clarifications
        '''

        global text
        #If click mode is activated, add user Click to Info:
        if click:
            click_message = return_click_point()
            complete_message = click_message + user_input
            text.append("[system]" + click_message)
            text.append("[User] " + user_input)
            messages.append({"role":"user","content": complete_message})
            print(complete_message)
        else:
            text.append("[User] " + user_input)
            messages.append({"role":"user","content": user_input})

        # loop to check and ask back
        while True:
            assistant_message = RequestGPT(messages, False)
            # exit if no content
            TextAnswer = RequestText(assistant_message)

            if TextAnswer:
                messages.append({"role":"assistant","content": TextAnswer})
                text.append("[GPT]" + TextAnswer)        

                # terminate conversation
                if "TERMINATE" in TextAnswer:
                    return messages
            
                # open window with question for user
                user_input = rs.EditBox(
                default_string = "",
                message = assistant_message.content,
                title = "RhinoGPT")
                user_input = assistant_message.content
            
            else:
                return messages
            
            messages.append({"role":"user","content": user_input})
            text.append("[User] " + user_input)

        return messages

    def Agent2(instruction, messages, completion):
        '''
        This agent instructs the LLM to first generate step-by-step instructions 
        for geometry creation.
        Args:
        -instruction: description of the agent step (generating description of functions the LLM will call)
        -messages: expandable log of conversation with LLM
        Returns:
        -messages: updated log of conversation with LLM, includes description of function calls the LLM will call
        '''
        # Append system message as user Instruction
        user_input = instruction
        messages.append({"role":"user","content": user_input})
        text.append("[User] " + user_input)

        assistant_message = RequestGPT(messages, False)

        TextAnswer = RequestText(assistant_message)

        if TextAnswer:
            response = TextAnswer
            text.append("[GPT] " + str(response))
            messages.append({"role":"assistant","content": response})

        return messages

    def Anthropic_Agent3(instruction, messages, completion):
        global FinishedCalled
        
        user_input = instruction
        messages.append({"role": "user", "content": user_input})
        
        if FinishedCalled:
            print("Anthropic Finished already everything in Agent 2! Exiting")
            messages.append({"role":"user","content": "Anthropic Finished already everything in Agent 2! Exiting"})
            return messages

        function_answer = RequestGPT(messages, tool_call=True, enforce=True)
        counter = 0

        while counter < 15:
            counter += 1
            print("--------------------- Function Call Found ---------------------")
            
            # Check if we have tool_use content blocks
            has_tool_use = False
            tool_results = []
            
            for content_block in function_answer:
                if hasattr(content_block, 'type') and content_block.type == 'tool_use':
                    has_tool_use = True
                    
                    # Extract tool information
                    function_name = content_block.name
                    function_input = content_block.input
                    tool_use_id = content_block.id
                    
                    print(f"Tool: {function_name}, Input: {function_input}")
                    
                    # Check for finished function
                    if str(function_name) == "finished":
                        FinishedCalled = True
                        break
                    
                    # ADD THE ACTUAL FUNCTION EXECUTION LOGIC HERE:
                    elif str(function_name) == "CreateCode":
                        print("---------------------- Execute Python Code ----------------------")
                        python_code = function_input["PythonCode"]
                        try: 
                            function_response = create_code(str(python_code))
                        except: 
                            function_response = "Unknown Execution Error during Code Creation"
                        content_message = "```Python_Code output: " + function_response + "```"
                        print(content_message)
                    else:
                        # SAVE TO JSON FILE (like in Agent3)
                        print("calling function:")
                        
                        # Parse function arguments
                        new_args = function_input
                        new_args = parse_list(new_args)
                        print(new_args)
                        
                        # Path to the JSON file
                        file_path = os.path.join(os.getcwd(), folder, f"{function_name}.json")
                        
                        # Check if file exists and merge data
                        if os.path.exists(file_path):
                            with open(file_path, "r") as tf:
                                try:
                                    existing_data = json.load(tf)
                                    if not isinstance(existing_data, dict):
                                        existing_data = {}
                                except json.JSONDecodeError:
                                    existing_data = {}
                        else:
                            existing_data = {}
                        
                        # Merge the new arguments into existing data
                        for key, value in new_args.items():
                            if key in existing_data:
                                if isinstance(value, list):
                                    existing_data[key].extend(value)
                                else:
                                    if not isinstance(existing_data[key], list):
                                        existing_data[key] = [existing_data[key]]
                                    existing_data[key].append(value)
                            else:
                                existing_data[key] = value if isinstance(value, list) else [value]
                        
                        # Store the merged data
                        with open(file_path, "w") as tf:
                            json.dump(existing_data, tf)
                        
                        content_message = f"successfully created {function_name} object. Call now the next function!"
                    
                    tool_results.append({
                        "type": "tool_result",
                        "tool_use_id": tool_use_id,
                        "content": content_message
                    })
            
            # Add assistant message
            messages.append({"role": "assistant", "content": function_answer})
            
            if FinishedCalled:
                break
                
            if has_tool_use and tool_results:
                # Add all tool results in a single user message
                messages.append({
                    "role": "user",
                    "content": tool_results
                })
            else:
                # No tool use, just continue
                messages.append({"role":"user","content": "Please call the next Function! If you are finished, call the finished function"})
            
            function_answer = RequestGPT(messages, tool_call=True, enforce=True)

        completion = True
        return messages

    def Agent3_DeepSeek(instruction, messages, completion):
        '''
        specific for deepseek
        ''' 

        # Append system message as user Instruction
        user_input = instruction
        messages.append({"role":"user","content": user_input})

        assistant_message = RequestGPT(messages, tool_call = True, enforce = True)
        crash_file_tracker(assistant_message)        
        # while function call (max Calls = 10)
        counter = 0

        returned_function_call = RequestFunction(assistant_message)

        # ------------------  GUARD  ------------------
        if returned_function_call is None:
            ds_append(messages, assistant_message)          
            return messages                                       
        # ---------------------------------------------


        while counter < 15: #This limit of 15 should be improved and be made case dependent
            counter += 1
            if returned_function_call == None or returned_function_call.name == '':
                print("no function call was appended!")
                response = assistant_message
                ds_append(messages, assistant_message)
                messages.append({"role":"user","content": "Please call the next function! If you are finished, call the finished function"})
                assistant_message = RequestGPT(messages, tool_call = True, enforce = True)
                returned_function_call = RequestFunction(assistant_message)

            function_name = returned_function_call.name
            function_str = returned_function_call.arguments

            try: new_args = json.loads(function_str)
            except: 
                try: new_args = json_repair.loads(function_str)
                except:
                    try: 
                        new_args = json_repair.loads(repair_python_to_JSON(function_str))
                        print("final repair attempt successful!")
                    except: new_args = function_str
            
            # Ensure all lists in the arguments have the same length:
            new_args = parse_list(new_args)  #Should only be necessary for ChatGPT 4 and 4o, and not Turbo
            print(new_args)


            print("--------------------- Function Call Found ---------------------")
            print("Function name: ")
            print(function_name)

            if str(function_name) == "finished":
                messages.append({
                    "role": "assistant",
                    "function_call": {
                        "name": function_name,
                        "arguments": json.dumps(new_args, ensure_ascii=False)   # ← statt str()
                    }
                })
                break

            elif str(function_name) == "CreateCode":
                print("---------------------- Execute Python Code ----------------------")
                arguments_dict = new_args
                python_code = arguments_dict["PythonCode"]
                try: function_response = create_code(str(python_code))
                except: function_response = "Unknown Execution Error during Code Creation"
                answer = "```Python_Code output: " + function_response + "```"
                print(answer)
                append_function(assistant_message, answer, new_args)
                print("Feeding Answer back to ", GPT,"...")
                assistant_message = RequestGPT(messages, tool_call = True, enforce = True)
                returned_function_call = RequestFunction(assistant_message)

            else:
                # get function name and arguments
                print("calling function:")
                
                crash_file_tracker(returned_function_call.arguments)

                # Path to the JSON file
                file_path = os.path.join(os.getcwd(), folder, f"{function_name}.json")

                # Check if the file exists and read existing data; if not, initialize an empty dict
                if os.path.exists(file_path):
                    with open(file_path, "r") as tf:
                        try:
                            existing_data = json.load(tf)
                            # Ensure existing_data is a dictionary
                            if not isinstance(existing_data, dict):
                                existing_data = {}
                        except json.JSONDecodeError:  # In case the file is empty or contains invalid JSON
                            existing_data = {}
                else:
                    existing_data = {}
                
                # Merge the new arguments into the existing data
                for key, value in new_args.items():
                    if key in existing_data:
                        # Assume the value is a list and append the new value(s)
                        if isinstance(value, list):
                            existing_data[key].extend(value)
                        else:
                            # If the existing or new value is not a list, make it a list and append
                            if not isinstance(existing_data[key], list):
                                existing_data[key] = [existing_data[key]]
                            existing_data[key].append(value)
                    else:
                        # If the key does not exist in the existing data, add it
                        existing_data[key] = value if isinstance(value, list) else [value]
                
                # Store the merged data
                with open(file_path, "w") as tf:
                    json.dump(existing_data, tf)

                # Add function call to messages

                append_function(assistant_message, "", new_args)

                logger(messages, logfile)
                print({"role": "assistant", "function_call": {"name": str(function_name), "arguments": str(new_args)}})
                    
                print("Calling for next Function")
                # Call again (assuming RequestGPT() is defined elsewhere and manages the loop)
                assistant_message = RequestGPT(messages, tool_call = True, enforce = True)
                returned_function_call = RequestFunction(assistant_message)                                                                                                                           

        print("Called all Functions")

        # if content -> output to user
        try:
            if assistant_message.content:
                response = RequestText(assistant_message)
                if completion:
                    global text
                    text.append("[GPT] " + response)
                messages.append({"role":"assistant", "content": response})

        except:
            print("No Content in Assistant Message")

        return messages

    def Agent3(instruction, messages, completion):
        '''
        Parses through the messages log, requests the creation of functions when it identifies a function message,
        identifies the function type (finished, createCode, or other) ***does something else I need to properly identify***
        and appends the working function to the message log.
        Args:
        -instruction: description of the agent step (generating description of functions the LLM will call)
        -messages: expandable log of conversation with LLM
        -completion: boolean indicating that stepPlanning step has already taken place; unsure of benefit here
        Returns:
        -messages: updated log of conversation with LLM, includes description of function calls the LLM will call
        ''' 

        # Append system message as user Instruction
        user_input = instruction
        messages.append({"role":"user","content": user_input})

        assistant_message = RequestGPT(messages, tool_call = True, enforce = True)
        crash_file_tracker(assistant_message)        
        # while function call (max Calls = 10)
        counter = 0

        returned_function_call = RequestFunction(assistant_message)

        while counter < 15: #This limit of 15 should be improved and be made case dependent
            counter += 1
            if returned_function_call == None or returned_function_call.name == '':
                print("no function call was appended!")
                response = assistant_message
                messages.append({"role":"assistant","content": response})
                messages.append({"role":"user","content": "Please call the next function! If you are finished, call the finished function"})
                assistant_message = RequestGPT(messages, tool_call = True, enforce = True)
                returned_function_call = RequestFunction(assistant_message)

            function_name = returned_function_call.name
            function_str = returned_function_call.arguments

            try: new_args = json.loads(function_str)
            except: 
                try: new_args = json_repair.loads(function_str)
                except:
                    try: 
                        new_args = json_repair.loads(repair_python_to_JSON(function_str))
                        print("final repair attempt successful!")
                    except: new_args = function_str
            
            # Ensure all lists in the arguments have the same length:
            new_args = parse_list(new_args)  #Should only be necessary for ChatGPT 4 and 4o, and not Turbo
            print(new_args)


            print("--------------------- Function Call Found ---------------------")
            print("Function name: ")
            print(function_name)

            if str(function_name) == "finished":
                messages.append({"role": "assistant", "function_call": {"name": str(function_name), "arguments": str(new_args)}})
                break

            elif str(function_name) == "CreateCode":
                print("---------------------- Execute Python Code ----------------------")
                arguments_dict = new_args
                python_code = arguments_dict["PythonCode"]
                try: function_response = create_code(str(python_code))
                except: function_response = "Unknown Execution Error during Code Creation"
                answer = "```Python_Code output: " + function_response + "```"
                print(answer)
                append_function(assistant_message, answer, new_args)
                print("Feeding Answer back to ", GPT,"...")
                assistant_message = RequestGPT(messages, tool_call = True, enforce = True)
                returned_function_call = RequestFunction(assistant_message)

            else:
                # get function name and arguments
                print("calling function:")
                
                crash_file_tracker(returned_function_call.arguments)

                # Path to the JSON file
                file_path = os.path.join(os.getcwd(), folder, f"{function_name}.json")

                # Check if the file exists and read existing data; if not, initialize an empty dict
                if os.path.exists(file_path):
                    with open(file_path, "r") as tf:
                        try:
                            existing_data = json.load(tf)
                            # Ensure existing_data is a dictionary
                            if not isinstance(existing_data, dict):
                                existing_data = {}
                        except json.JSONDecodeError:  # In case the file is empty or contains invalid JSON
                            existing_data = {}
                else:
                    existing_data = {}
                
                # Merge the new arguments into the existing data
                for key, value in new_args.items():
                    if key in existing_data:
                        # Assume the value is a list and append the new value(s)
                        if isinstance(value, list):
                            existing_data[key].extend(value)
                        else:
                            # If the existing or new value is not a list, make it a list and append
                            if not isinstance(existing_data[key], list):
                                existing_data[key] = [existing_data[key]]
                            existing_data[key].append(value)
                    else:
                        # If the key does not exist in the existing data, add it
                        existing_data[key] = value if isinstance(value, list) else [value]
                
                # Store the merged data
                with open(file_path, "w") as tf:
                    json.dump(existing_data, tf)

                # Add function call to messages

                append_function(assistant_message, "", new_args)

                logger(messages, logfile)
                print({"role": "assistant", "function_call": {"name": str(function_name), "arguments": str(new_args)}})
                    
                print("Calling for next Function")
                # Call again (assuming RequestGPT() is defined elsewhere and manages the loop)
                assistant_message = RequestGPT(messages, tool_call = True, enforce = True)
                returned_function_call = RequestFunction(assistant_message)                                                                                                                           

        print("Called all Functions")

        # if content -> output to user
        try:
            if assistant_message.content:
                response = RequestText(assistant_message)
                if completion:
                    global text
                    text.append("[GPT] " + response)
                messages.append({"role":"assistant", "content": response})

        except:
            print("No Content in Assistant Message")

        return messages

    # -----------------------*** MAIN PROGRAM ***-----------------------

    if go:
        running = True
        
        # -----------------------*** START CONTACT WITH LLM API ***-----------------------

        messages = [{"role": "system", "content": "LOG RESET"}]
        text = []
        text.append("[Prog] New Conversation. Press \"Start\" to begin.")

        # reset function arguments
        arg_files = glob.glob("temp\*.json")

        for arg_file in arg_files:
            try:
                os.remove(arg_file)
            except OSError as e:
                print(f"Error deleting function argument files")

        with open(logfile, "w", encoding="utf-8") as tf:
            json.dump(messages, tf, ensure_ascii=False)

        # Load and hand over API key, load function definitions and modify them to structure expected by each provider
        if GPT == "ChatGPT":
            key = open("key.txt", "r")
            api_key = key.read()
            openai_old.api_key = api_key


            functions = []
            # get provided functions, already in format expected by OpenAI
            for function_name in glob.glob("functions\*.json"):
                with open(os.path.join(os.getcwd(), function_name), "r") as function:
                    functions.append(json.load(function))
        if GPT == "DeepSeek":
            key = open("deepseek_key.txt", "r")
            api_key = key.read()

            DeepSeek_client = DeepSeekAI(api_key=api_key, base_url="https://api.deepseek.com")

            functions = []
            for function_name in glob.glob("functions/*.json"):
                with open(os.path.join(os.getcwd(), function_name), "r") as function:
                    functions.append(json.load(function))

        if GPT == "Anthropic":
            key = open("anthropic_key.txt", "r")
            api_key = key.read()
            client = Anthropic(
                # This is the default and can be omitted
                api_key=api_key,
            )
            model = Anthropic_model  # or Expensive: "claude-3-opus-20240229" Fast: "claude-3-haiku-20240307" Intermediate: "claude-3-sonnet-20240229"
            
            functions = []
            # get provided functions, adapt them to format expected by Anthropic
            for function_name in glob.glob("functions/*.json"):
                with open(os.path.join(os.getcwd(), function_name), "r") as function_file:
                    function_data = json.load(function_file)
                    # Rename 'parameters' key to 'input_schema'
                    if 'parameters' in function_data:
                        function_data['input_schema'] = function_data.pop('parameters')
                    functions.append(function_data)

        if GPT == "Mistral":
            key = open("mistral_key.txt", "r")
            api_key = key.read()
            model = "mistral-large-2402"

            #Function calls are exactly the same as with ChatGPT
            functions = []
            # get provided functions
            for function_name in glob.glob("functions/*.json"): 
                with open(os.path.join(os.getcwd(), function_name), "r") as function_file:
                    # Load the original function data
                    function_data = json.load(function_file)

                    # Modify the structure as requested
                    modified_function = {
                        "type": "function",
                        "function": function_data
                    }
                    functions.append(modified_function)

        if GPT == "Gemini":
            geometry_tool = create_tool_from_json(directory_path)
            Gemini_ChatHistory = []

            google_id = open("google_project_id.txt" , "r")
            project_id = google_id.read()
            
            vertexai.init(
                project = project_id,   # ← DEINE PROJEKT-ID EINTRAGEN
                location = "europe-west4"       # oder z. B. "europe-west4", je nach Region
            )


        # -----------------------*** DEFINE SYSTEM AND ASK FOR INITIAL USER INPUT ***-----------------------

        # taskfile contains the system and agent workflow descriptions, not the prompt!
        with open(taskfile, "r", encoding="utf-8") as task_file:
            task = json.load(task_file)
        
        with open(logfile, "r", encoding="utf-8") as log_file:
            messages = json.load(log_file)

        # "content" can be changed
        messages = [{"role": "system", "content": "LOG RESET"}]
        text = []
        text.append("[Prog] New Conversation. Press \"Start\" to begin.")
        status = "Programm has Started"

        # Find the dictionary with role 'system'
        for item in messages:
            if item["role"] == "system":
                # Update the content
                if item["content"] == "LOG RESET":
                    messages = []
                    again = False
                    ask = "Describe your request"
                else:
                    again = True
                    ask = "What do you want to add or change?"

        user_input = load_prompts(prompt_name)
        # get user input: (works on Rhino/GH interface)
        # user_input = rs.EditBox(
        #     default_string = "",
        #     message = ask,
        #     title = "RhinoGPT")

        system_message = str(task["system_message"])
        
        if GPT == "ChatGPT":
            messages.append({"role":"system","content": system_message})
        if GPT == "Mistral":
            messages.append({"role":"system","content": system_message})
        if GPT == "Anthropic":
            user_input = "system_message" + " User Input: " + user_input
        if GPT == "Gemini":
            user_input = system_message + " User Input: " + user_input


        # -----------------------*** AGENT WORFKLOW PROCESS ***-----------------------
        # Step-by-step process, in which each steps 1, 2, 4 represents an agent workflow:
        #   step1: askBack
        #   step2: stepPlanning
        #   step3: execute prepared function calls and make use of the createCode function if needed
        #   step4: visualInspection, not included in this script
        # The steps within each step are carried out via the Agent1, Agent2, and Agent3 functions.
        
        Allow_askback = False

        if  AgentMode == "askBack":
            Allow_askback = True
        
        if AgentMode == "visualInspection":
            visualInspection_trigger = True
        else:
            visualInspection_trigger = False

        if GPT == "Anthropic":
            status = "Getting Instructions"
            instruction = str(task["step1"])
            
            if AgentMode in ["StepPlanning", "askBack", "visualInspection"]:
                if Allow_askback:
                    status = "Starting Step1"
                    logger(messages, logfile)
                    messages = Agent1(user_input, str(task["step1"]), messages, again)
                    status = "Finished Step 1, starting Step 2"
                    instruction = str(task["step2"])
                else:
                    status = "Skipping Step 1"
                    instruction = user_input + " | " + str(task["step2"])

                completion = False

                # stepPlanning
                logger(messages, logfile)
                messages = Agent2(instruction, messages, completion)
                status = "Finished Step 2, running Step 3"

                # Define next instruction
                logger(messages, logfile)
                instruction = str(task["step3"])
                completion = True

                # Execution
                logger(messages, logfile)
                messages = Anthropic_Agent3(instruction, messages, completion)
                status = "Finished Step 3, program run was succesfully"
                logger(messages, logfile)

                agent = AgentMode

            elif AgentMode == "ZeroShot":
                status = "Starting ZeroShot Execution"
                instruction = user_input + " | " + str(task["step3"])
                completion = True

                # Directly execute Agent3 (skip Agent1 + Agent2)
                logger(messages, logfile)
                messages = Anthropic_Agent3(instruction, messages, completion)
                status = "Finished ZeroShot execution"
                logger(messages, logfile)
                
                agent = AgentMode
            else:
                print(f"Invalid AgentMode: {AgentMode}")

        elif GPT == "DeepSeek":
            status = "Getting Instructions"
            instruction = str(task["step1"])
                    
            if AgentMode in ["StepPlanning", "askBack", "visualInspection"]:
                if Allow_askback:
                    status = "Starting Step1"
                    logger(messages, logfile)
                    messages = Agent1(user_input, str(task["step1"]), messages, again)
                    status = "Finished Step 1, starting Step 2"
                    instruction = str(task["step2"])
                else:
                    status = "Skipping Step 1"
                    instruction = user_input + " | " + str(task["step2"])

                completion = False

                # stepPlanning
                logger(messages, logfile)
                messages = Agent2(instruction, messages, completion)
                status = "Finished Step 2, running Step 3"

                # Define next instruction
                logger(messages, logfile)
                instruction = str(task["step3"])
                completion = True

                # Execution
                logger(messages, logfile)
                messages = Agent3_DeepSeek(instruction, messages, completion)
                status = "Finished Step 3, program run was succesfully"
                logger(messages, logfile)

                agent = AgentMode

            elif AgentMode == "ZeroShot":
                status = "Starting ZeroShot Execution"
                instruction = user_input + " | " + str(task["step3"])
                completion = True

                # Directly execute Agent3 (skip Agent1 + Agent2)
                logger(messages, logfile)
                messages = Agent3_DeepSeek(instruction, messages, completion)
                status = "Finished ZeroShot execution"
                logger(messages, logfile)
                        
                agent = AgentMode
            else:
                print(f"Invalid AgentMode: {AgentMode}")

        else:
            status = "Getting Instructions"
            instruction = str(task["step1"])
            
            if AgentMode in ["StepPlanning", "askBack", "visualInspection"]:
                if Allow_askback:
                    status = "Starting Step1"
                    logger(messages, logfile)
                    messages = Agent1(user_input, str(task["step1"]), messages, again)
                    status = "Finished Step 1, starting Step 2"
                    instruction = str(task["step2"])
                else:
                    status = "Skipping Step 1"
                    instruction = user_input + " | " + str(task["step2"])

                completion = False

                # stepPlanning
                logger(messages, logfile)
                messages = Agent2(instruction, messages, completion)
                status = "Finished Step 2, running Step 3"

                # Define next instruction
                logger(messages, logfile)
                instruction = str(task["step3"])
                completion = True

                # Execution
                logger(messages, logfile)
                messages = Agent3(instruction, messages, completion)
                status = "Finished Step 3, program run was succesfully"
                logger(messages, logfile)

                agent = AgentMode

            elif AgentMode == "ZeroShot":
                status = "Starting ZeroShot Execution"
                instruction = user_input + " | " + str(task["step3"])
                completion = True

                # Directly execute Agent3 (skip Agent1 + Agent2)
                logger(messages, logfile)
                messages = Agent3(instruction, messages, completion)
                status = "Finished ZeroShot execution"
                logger(messages, logfile)
                
                agent = AgentMode
            else:
                print(f"Invalid AgentMode: {AgentMode}")  

        change = True

        if GPT == "Anthropic":
            print("attempting Sanitization of Subtraction Field")
            try: sanitize_subtraction_field(folder)
            except: print("Sanitization Failed")
            
        destination = copy_files_and_folders(Path(base_destination_path), new_folder_name)
        with open("destination.txt", "w", encoding="utf-8") as file:
            file.write(destination)

    elif reset:

        # -----------------------*** CLEAR LOG AND CONVERSATION ***-----------------------
        # Used only if go is false and reset is true

        #Clear stdout for logging:
        #sys.stdout = sys.__stdout__

        messages = [{"role": "system", "content": "LOG RESET"}]
        text = []
        text.append("[Prog] New Conversation. Press \"Start\" to begin.")

        # reset function arguments
        arg_files = glob.glob("temp\*.json")

        for arg_file in arg_files:
            try:
                os.remove(arg_file)
            except OSError as e:
                print(f"Error deleting function argument files")

        with open(logfile, "w", encoding="utf-8") as tf:
            json.dump(messages, tf, ensure_ascii=False)
# ---------- end gpt ----------

# ---- group: Output Directory (continued)
text_join = TextJoin(Text=[directory_path, panel_5])
read_file = ReadFile(File=text_join, PerLineParse=True)  # -> flatten(Content)
directory_path_2 = Panel(read_file)
text_join_2 = TextJoin(Text=[directory_path_2, "\temp"])
interaction_history = InteractionHistory(text=[text_join_2, "\terminal_output.txt"])
interaction_history_2 = Panel(interaction_history)

# ----
concatenate = Concatenate(FragmentA=directory_path_2, FragmentB="\preview.png")
panel_6 = Panel(concatenate)
save_viewport_to_file = SaveViewportToFile(Run=visual_check, Render=False, FilePath=concatenate, ScaleFactor=1)
go_2 = BooleanToggle(True)
boolean_toggle = BooleanToggle(False)
gpt_check = Python3Script(
    allow_run=Toggle(True),
    path=directory_path,
    go=go_2,
    OpenAI_model=json_reader.model_out,
    image=save_viewport_to_file,
    base_destination_path=directory_path_2)  # -> out, a, improve, base_destination_path
# ---------- gpt_check: Python ----------
import os

if os.path.exists(image):

    if allow_run:
        
        import base64
        import openai
        from openai import OpenAI
        from io import BytesIO
        from PIL import Image
        import json
        import shutil
        import rhinoscriptsyntax as rs

        os.chdir(path)
        improve = False

        taskfile = "task.json"

        # get task
        with open(taskfile, "r") as tf:
            task = json.load(tf)


        # define logfile
        logfile = os.path.join(base_destination_path, "log.json")


        def encode_image(image_path, max_image=512):
            with Image.open(image_path) as img:
                width, height = img.size
                max_dim = max(width, height)
                if max_dim > max_image:
                    scale_factor = max_image / max_dim
                    new_width = int(width * scale_factor)
                    new_height = int(height * scale_factor)
                    img = img.resize((new_width, new_height))

                buffered = BytesIO()
                img.save(buffered, format="PNG")
                img_str = base64.b64encode(buffered.getvalue()).decode("utf-8")
                return img_str

        with open("key.txt", "r") as key_file:
            api_key = key_file.read()
        openai.api_key = api_key


        #client = OpenAI()
        image_file = image
        max_size = 512  # set to maximum dimension to allow (512=1 tile, 2048=max)
        encoded_string = encode_image(image_file, max_size)

        system_prompt = task["step4"]
        user = ("Here is the image of the part. Does it look like requested?")
        # Backup original logfile
        logfile_visualInspection = os.path.join(base_destination_path, "prompt_visualInspection.json")

        with open(logfile, "r") as tf:
            messages_input = json.load(tf)

        # function calling need to be deleted, because it can not be processed with this GPT-version
        #messages = [entry for entry in messages_input if "function_call" not in entry]
        messages = [entry for entry in messages_input]

        # replace system message
        for item in messages:
            if item["role"] == "system":
            # Update the content
                system_prompt_old = item["content"]
                item["content"] = system_prompt

        # insert user message and picture
        messages.append(
            {
                "role": "user",
                "content":
                [
                    {"type": "text", "text": user},
                    {
                        "type": "image_url",
                        "image_url": {"url":
                            f"data:image/jpeg;base64,{encoded_string}"}
                    }
                ]
            }
        )

        if go:
            # apiresponse = client.chat.completions.with_raw_response.create(
            #     model="gpt-4-vision-preview",
            #     messages=messages,
            #     max_tokens=500,
            # )
            apiresponse = openai.chat.completions.with_raw_response.create(
                model= OpenAI_model,
                messages=messages,
                max_tokens=500,
            )
            debug_sent = apiresponse.http_request.content
            chat_completion = apiresponse.parse()
            print(chat_completion.choices[0].message.content)
            print(chat_completion.usage.model_dump())
            print(
                "remaining-requests: "
                f"{apiresponse.headers.get('x-ratelimit-remaining-requests')}"
            )


            response = chat_completion.choices[0].message.content
            response_original = response


            if "IMPROVE" in response.upper():
                # add message
                response = response.replace("IMPROVE","")
                improve = True
            else:
                improve = False
            
            with open(logfile_visualInspection, "w") as tf:
                json.dump(messages , tf , default=str)
            
            for item in messages_input:
                if item["role"] == "system":
                # Update the content
                    item["content"] = system_prompt_old
            
            messages_input.append({"role":"user","content":"Please check the result"})
            messages_input.append({"role":"assistant","content":response})
            # store in log file
            
            with open(logfile, "w") as tf:
                json.dump(messages_input, tf)
a = response_original
# ---------- end gpt_check ----------
panel_7 = Panel(gpt_check.improve)
panel_8 = Panel(gpt_check.a)
gpt_improve = Script(
    allow_run=visual_improve,
    improve=gpt_check.improve,
    reset=reset,
    GPT=value_list,
    OpenAI_model=json_reader.model_out,
    prompt_name=json_reader.geometry_out,
    base_destination_path=base_destination_path,
    path=directory_path,
    response_path=gpt_check.base_destination_path)
# ---------- gpt_improve: Python ----------
    # #Uncomment in third-party IDE
    # allow_run = True
if allow_run:
    if improve:

        # -----------------------*** IMPORT MODULES ***-----------------------

        ## Uncomment in GH (rhinoscriptsyntax can only run in GH python component)
        import rhinoscriptsyntax as rs


        # GENERAL MODULES
        import logging
        import os
        import shutil
        import sys
        import json_repair
        import json
        import glob
        import time
        import re
        from typing import List
        from dataclasses import dataclass
        from typing import Optional, Any
        from pathlib import Path
        import sys


        # LLM MODULES
        
        # Claude
        from anthropic import Anthropic

        # ChatGPT
        import openai
        
        # Mistral
        from mistralai.client import MistralClient
        from mistralai.models.chat_completion import ChatMessage

        # Google Gemini (not currently in use)
        from google.cloud import storage
        import vertexai
        from vertexai.generative_models import GenerationConfig, GenerativeModel, Image, Part, Content, FunctionDeclaration, Tool
        from vertexai.generative_models._generative_models import ToolConfig
        import google.ai.generativelanguage as glm

        # Meta LLaMa (potentially)
    


        # -----------------------*** VARIABLE AND PATH INITILIZATION ***-----------------------

        # # Uncomment if editing in third-party IDE, otherwise inputs directly from input block in GH
        # go = True
        # reset = False
        # FinishedCalled = False
        # Allow_askback = False

        # GPT = "ChatGPT"
        # OpenAI_model = "gpt-4o"
        # prompt_name ="toycar_a"

        # # replace path with location of CodeEnvironment folder. CodeEnvironment contains:
        #     # functions folder: block.json, cylinder.json, finished.json, force.json, CreateCode.json
        #     # temp folder: instances of functions (JSON files), crash_file.txt, terminal_output.txt
        #     # keys for ChatGP (key.txt), Anthropic, and Mistral
        #     # geometry_creation.py: module containing function defintions for functions that parse JSON object instances into rhinoscriptsyntax 
        #         # functions, imported into CreateGeometries python block in GH (Note: brings up the question of why that is not done in GPT 
        #         # python block as well.
        #     # log.json: contains log of conversation with LLM, including the system definition, prompt, and function instantiations
        #     # task.json: contains the descriptions of the system and each agent workflow (askBack, stepPlanning, visualInspection)
        #     # test_prompts.json: contains text prompts
            
        # path = r"P:\01_Research_projects\2023_DNT_LLM_in_Engineering_Applications\04_Paper\Code\Grasshopper\CodeEnvironment"

        # # replace base_destination_path with location of folder where results will be saved. These include:
        #     # temp folder
        #     # log.json
        #     # STL file (if exported)

        # base_destination_path = r"P:\01_Research_projects\2023_DNT_LLM_in_Engineering_Applications\04_Paper\Experiments\Different GPT\ChatGPT"

        ## Uncomment until here

        # number attached to end of new_folder_name will be increased automatically
        new_folder_name= "TestPrompts"

        logfile = "log.json"
        taskfile = "task.json"

        debug = True
        change = False
        click = False
        click_filename = "Click"

        # Set LLM functions relative path 
        directory_path = "functions/"  # Adjust the path to your functions directory

        current_dir = os.getcwd()
        if current_dir not in sys.path:
            sys.path.append(current_dir)

        os.chdir(path)

        sys.path.append

        # Create temp folder
        folder = "temp"
        # Relative terminal path
        terminal_path = os.path.join(folder, "terminal_output.txt")
        # Absolute terminal path
        gh_terminal_path = os.path.join(path, terminal_path)
    
        text = [] #Does not appear to be necessary, consider removing

        # All inputs and responses are appended to messages and periodically logged onto log.json
        messages = []

        # -----------------------*** FUNCTIONS ***-----------------------
        # Note: Should be found in a separate module and then imported with something like this:
        # from gpt_functions import *, but currently many function definitions depend on variables in the main program 
        # that are not passed to the function definitons, so simply copy and pasting these functions onto a separarte
        # module is complicated


        # LOGGING
        class StreamToLogger:
            """
            Custom stream object that redirects writes to a logger instance.
            """
            def __init__(self, logger, log_level=logging.INFO):
                self.logger = logger
                self.log_level = log_level
                self.linebuf = ''

            def write(self, buf):
                for line in buf.rstrip().splitlines():
                    self.logger.log(self.log_level, line.rstrip())

            def flush(self):
                pass

        # Set up logging
        logging.basicConfig(filename=terminal_path,
                            filemode='w',
                            format='%(message)s',
                            level=logging.INFO)
        logger = logging.getLogger()

        # Redirect stdout to the logging handler
        sys.stdout = StreamToLogger(logger, logging.INFO)

        def logger(messages, logfile):
            with open(logfile, "w") as tf:
                # Use the default parameter to specify your conversion function
                json.dump(messages, tf, default=default_converter)


        # FORMATTING AND DATA TRANSFER
        def custom_serializer(obj):
            if hasattr(obj, 'fields'):
                # Assumes fields is a dictionary of key-value pairs
                return {k: custom_serializer(v) for k, v in obj.fields.items()}
            elif hasattr(obj, 'number_value'):
                # Direct conversion of number_value
                return obj.number_value
            elif hasattr(obj, 'struct_value'):
                # Recursive handling of struct_value
                return custom_serializer(obj.struct_value)
            elif hasattr(obj, 'list_value'):
                # Handle list values
                return [custom_serializer(item) for item in obj.list_value]
            else:
                # Check for other types that json can serialize directly
                try:
                    json.dumps(obj)
                    return obj
                except TypeError:
                    # Final catch for any types that are still not handled
                    return str(obj)

        def parse_list(arguments):
            # Filter out non-list values and empty lists
            list_values = [v for v in arguments.values() if isinstance(v, list)]
            print("--------------------------Parsing Function Arguments -------------------------------")
            if not list_values:
                # If there are no lists, return original arguments
                print("No lists found in the arguments.")
                return arguments
            
            # Determine the maximum length among all non-empty lists
            max_length = max(len(v) for v in list_values)

            # Ensure boolean lists remain as lists of booleans
            for key, value in arguments.items():
                if isinstance(value, list) and all(isinstance(item, bool) for item in value):
                    print(f"Ensuring boolean list for key '{key}' remains as booleans.")
                    value[:] = [bool(item) for item in value]
            
            # Iterate through each key and update lists as needed
            for key, value in arguments.items():
                if isinstance(value, list):
                    current_length = len(value)
                    if current_length < max_length:
                        if current_length == 0:
                            value.extend([0] * max_length)
                            print(f"\033[91mFilled '{key}' with {max_length} zeros.\033[0m")
                        else:
                            last_element = value[-1]
                            additional_elements = max_length - current_length
                            value.extend([last_element] * additional_elements)
                            print(f"Added {additional_elements} elements with value '{last_element}' to '{key}'.")
                    elif current_length == 0:
                        value.extend([0] * max_length)
                        print(f"\033[91mFilled '{key}' with {max_length} zeros.\033[0m")
            
            return arguments

        def create_unique_folder(base_path, base_name):
            # Start with index 1 since the first folder should be base_name_1
            index = 1
            while True:
                new_folder_name = f"{base_name}_{index}"
                new_folder_path = os.path.join(base_path, new_folder_name)
                if not os.path.exists(new_folder_path):
                    os.makedirs(new_folder_path)
                    print(f"Created directory: {new_folder_path}")
                    return new_folder_path
                index += 1

        def copy_files_and_folders(base_destination, folder_name, destination = None):
            # Create a unique folder inside the destination
            if destination is None:
                destination = create_unique_folder(base_destination, folder_name)
            
            # List of items to copy
            items_to_copy = ['temp', 'log.json']
            
            for item in items_to_copy:
                # Construct source path
                source_path = os.path.join(os.getcwd(), item)
                # Construct destination path within the newly created unique folder
                dest_path = os.path.join(destination, item)
                
                # Check if the item exists before attempting to copy
                if os.path.exists(source_path):
                    if os.path.isdir(source_path):
                        # Copy the directory recursively
                        shutil.copytree(source_path, dest_path, dirs_exist_ok=True) 
                        print(f"Copied {item} to {destination}")
                    else:
                        # Copy the file
                        shutil.copy(source_path, dest_path)
                        print(f"Copied {item} to {destination}")
                else:
                    print(f"{item} does not exist in the source directory.")
            return destination

        def repair_python_to_JSON(json_like_string):
            # Temporarily replace escaped single quotes to avoid conversion
            temp_placeholder = re.sub(r"\\'", "TEMP_SINGLE_QUOTE", json_like_string)
            
            # Convert single quotes to double quotes
            repaired_string = temp_placeholder.replace("'", '"')
            
            # Revert temporarily replaced escaped single quotes back to original
            repaired_string = re.sub(r"TEMP_SINGLE_QUOTE", "\\'", repaired_string)
            
            # Replace Python's True and False with JSON's true and false
            repaired_string = re.sub(r"\bTrue\b", "true", repaired_string)
            repaired_string = re.sub(r"\bFalse\b", "false", repaired_string)
            
            # Replace Python's None with JSON's null
            repaired_string = re.sub(r"\bNone\b", "null", repaired_string)
            
            return repaired_string

        def sanitize_subtraction_field(directory: str) -> None:
            """
            Sanitizes the 'subtraction' field in all .json files within the given directory.
            Args:
            - directory (str): The path to the directory containing the .json files to be sanitized.
            """
            # List all JSON files in the directory
            for filename in os.listdir(directory):
                if filename.endswith(".json"):
                    file_path = os.path.join(directory, filename)
                    with open(file_path, "r") as file:
                        print(f"Sanitizing file {filename}")
                        try:
                            data = json.load(file)
                            # Check if "subtraction" field exists and needs sanitization
                            if "subtraction" in data and isinstance(data["subtraction"], List):
                                sanitized_subtraction = sanitize_subtraction_list(data["subtraction"])
                                data["subtraction"] = sanitized_subtraction
                                # Save the modified data back to the file
                                with open(file_path, "w") as outfile:
                                    json.dump(data, outfile)
                        except json.JSONDecodeError:
                            print(f"Skipping file {filename} due to JSON decoding error.")

        def sanitize_subtraction_list(subtraction_list: List[str]) -> List[str]:
            """
            Converts a list of stringified boolean lists into a list of string booleans.
            Args:
            - subtraction_list (List[str]): The original list of stringified boolean lists.
            Returns:
            - List[str]: A sanitized list of string booleans.
            """
            sanitized_list = []
            # Regular expression to find all boolean values in the string
            boolean_pattern = re.compile(r"True|False", re.IGNORECASE)
            for item in subtraction_list:
                # Find all boolean values in the current string
                bool_strings = boolean_pattern.findall(item)
                # Convert boolean strings to their lowercase string representations and extend the sanitized list
                sanitized_list.extend([bs.lower() for bs in bool_strings])
            return sanitized_list

        def default_converter(o):
            try:
                # Attempt to use the object's own method to convert it to a serializable form, if available
                return o.__dict__
            except AttributeError:
                # If it doesn't work, just convert the object to a string
                return str(o)

        def crash_file_tracker(variable):
            crashfile = str(variable)
            with open(os.path.join(os.getcwd(), folder, "crash_file.txt"), "w") as tf:
                tf.write(crashfile)

        def store_and_merge(new_args, function_name):
            # Path to the JSON file
            file_path = os.path.join(os.getcwd(), folder, f"{function_name}.json")
            
            # Check if the file exists and read existing data; if not, initialize an empty dict
            if os.path.exists(file_path):
                with open(file_path, "r") as tf:
                    try:
                        existing_data = json.load(tf)
                        # Ensure existing_data is a dictionary
                        if not isinstance(existing_data, dict):
                            existing_data = {}
                    except json.JSONDecodeError:  # In case the file is empty or contains invalid JSON
                        existing_data = {}
            else:
                existing_data = {}
            
            # Merge the new arguments into the existing data
            for key, value in new_args.items():
                if key in existing_data:
                    # Assume the value is a list and append the new value(s)
                    if isinstance(value, list):
                        existing_data[key].extend(value)
                    else:
                        # If the existing or new value is not a list, make it a list and append
                        if not isinstance(existing_data[key], list):
                            existing_data[key] = [existing_data[key]]
                        existing_data[key].append(value)
                else:
                    # If the key does not exist in the existing data, add it
                    existing_data[key] = value if isinstance(value, list) else [value]
            
            # Store the merged data
            with open(file_path, "w") as tf:
                json.dump(existing_data, tf)

        def normalize_booleans_in_string(json_str):
            # Find all occurrences of True/False and replace them with true/false
            if "True" in json_str or "False" in json_str:
                print("\033[91mFound and modifying booleans in JSON string.\033[0m")
            json_str = json_str.replace("True", "true").replace("False", "false")
            return json_str

        def serialize_proto_value(value):
            """Converts Protocol Buffer RepeatedComposite or other non-serializable values to Python native types."""
            if hasattr(value, 'extend'):  # Check if it behaves like a list
                return [v for v in value]
            else:
                return value

        def load_prompts(prompt_name):
            # Dynamically loading and printing all variables
            try:
                print("Loading Test-Prompts")
                with open('test_prompts.json', 'r') as json_file:
                    data = json.load(json_file)
                return data.get(prompt_name)
            except:
                print("\033[91mError during loading of test prompts\033[0m")
                return None


        @dataclass
        class FunctionCall:
            name: Optional[str] = None
            arguments: Optional[str] = None  # Arguments as a JSON string or None

        @dataclass
        class ChatCompletionMessage:
            role: str
            function_call: Optional[FunctionCall] = None
            content: Optional[str] = None
            tool_calls: Optional[Any] = None


        # CREATE CODE AND TOOLS FROM LLM RESPONSE
        def create_code(PythonCode):
            # Preprocess the PythonCode to indent it correctly
            indented_code = "    " + PythonCode.replace('\n', '\n    ')
            # Construct the wrapped code with the pre-indented Python code
            wrapped_code = "def temp_function():\n" + indented_code + "\n    return locals()"
            try:
                local_env = {}
                exec(wrapped_code, {}, local_env)  # Execute the wrapped function definition
                result = local_env['temp_function']()  # Call the newly defined function and get the return value
                # Assuming the result is a dictionary of values you want to return
                return str(result)
            except Exception as e:
                return f"the function failed and returned: {str(e)}"

        def create_tool_from_json(directory_path):
            function_declarations = []
            for function_file in glob.glob(os.path.join(directory_path, "*.json")):
                with open(function_file, "r") as file:
                    function_definition = json.load(file)
                    
                    # Remove the 'default' keys from parameters if they exist
                    for param in function_definition['parameters']['properties'].values():
                        if 'default' in param:
                            del param['default']
                    
                    function_declaration = FunctionDeclaration(
                        name=function_definition["name"],
                        description=function_definition["description"],
                        parameters=function_definition["parameters"]
                    )
                    function_declarations.append(function_declaration)
            
            return Tool(function_declarations=function_declarations)

        # CLICKING (NOT YET FUNCTIONING)
        def return_click_point():
            #Store Info
            
            click_file_path = os.path.join(os.getcwd(), folder, f"{click_filename}.txt")
            if os.path.exists(click_file_path):
                with open(click_file_path, 'r') as file:
                    click_data_loaded = json.load(file)    

            point_coords = click_data_loaded['point']
            vector_coords = click_data_loaded['vector']
            Click_Point = rs.CreatePoint(round(point_coords['x'], 2), round(point_coords['y'],2 ), round( point_coords['z'],2 ))
            Click_Normal = rs.CreateVector(vector_coords['x'], vector_coords['y'], vector_coords['z'])
            Click_string = f"The user clicked at the Position: {Click_Point[0]},{Click_Point[1]},{Click_Point[2]} " \
                f"with the normal facing in the direction: {Click_Normal[0]},{Click_Normal[1]},{Click_Normal[2]}"
            return Click_string


        # FUNCTIONS DEPENDENT ON LLM PROVIDER
        def toChatGPT(message): # appears to only be used in toGemini
            if debug == True:
                print("message to ChatGPT: ")
                print(message)
            function_name = None
            args_json = None

            # Check if there's a function call in the message
            if hasattr(message.parts[0], 'function_call') and message.parts[0].function_call:
                function_name = message.parts[0].function_call.name
                # Serialize arguments using the custom serializer
                args_dict = {key: serialize_proto_value(value) for key, value in message.parts[0].function_call.args.items()}
                args_json = json.dumps(args_dict, ensure_ascii=False, default=custom_serializer)

            # Safely check if there's text in the message
            message_text = None
            try:
                if message.parts[0].text:  # This line may raise ValueError if text is not present
                    message_text = message.parts[0].text
            except AttributeError:
                pass  # No text in the message part, handle as needed

            # Create the FunctionCall object if a function call exists
            function_call = FunctionCall(name=function_name, arguments=args_json) if function_name and args_json else None

            # Create the ChatCompletionMessage object
            chat_message = ChatCompletionMessage(role='model', function_call=function_call, content=message_text)

            return chat_message

        def toGemini(full_message): # not in use
            # Extract the last message
            last_message = full_message[-1]
            
            # Determine the role and convert it to Gemini API role
            gemini_role = 'user' if last_message['role'] == 'user' else 'model'

            if gemini_role == 'user':
                return last_message['content']
            else:
                return ""

        def RequestFunction(assistant_message):
            '''
            Get function for function implementation from unique LLM response assistant_message
            '''
            if GPT == "Anthropic":
                class FunctionExtractor:
                    def __init__(self, assistant_message):
                        # Extracting the ToolUseBlock from the assistant message
                        
                        try:
                            self._name = assistant_message[1].name
                            self._arguments = assistant_message[1].input
                            self._id = assistant_message[1].id
                        except:
                            print("Error During Reading of Function Call")
                            self._name = ''
                            self._arguments = {}
                            self._id = ''
                            

                    @property
                    def name(self):
                        return self._name

                    @property
                    def arguments(self):
                        return self._arguments
                    
                    @property
                    def id(self):
                        return self._id

                # Creating and returning an instance of FunctionExtractor with the provided assistant message
                return FunctionExtractor(assistant_message)

            if GPT == "Mistral":
                return assistant_message.tool_calls[0].function

            if GPT == "Gemini":
                return assistant_message.function_call

            if GPT == "ChatGPT":      
                return assistant_message.function_call
            
        def append_function(assistant_message, answer = "", new_args = ""):
            '''
            Appends function implementation to messages
            '''
            returned_function_call = RequestFunction(assistant_message)
            function_name = returned_function_call.name


            if answer == "":
                content_message = "successfully created " + function_name + " object. Call now the next function!"
                print("generated answer: " + content_message)
            else:
                print("answered with: " + answer)
                content_message = answer

            if GPT == "Mistral":
                messages.append(assistant_message)
                messages.append(ChatMessage(role="tool", name=str(function_name), content=content_message))
                return messages
            
            elif GPT == "Gemini":
                messages.append({"role":"user","content": "Execute now the next function call. If you already executed all functions, call the finished function"})
                return messages
            
            elif GPT == "ChatGPT":
                messages.append({"role": "assistant", "function_call": {"name": str(function_name), "arguments": str(new_args)}})
                messages.append({"role": "user","content": content_message})
                #messages.append({"role":"user","content": "Execute now the next function call. If you already executed all functions, call the finished function"})
                return messages
            
            
            
            elif GPT == "Anthropic":
                messages.append({"role": "assistant", "content": assistant_message})
                id = returned_function_call.id

                messages.append({"role":"user","content": [{"type": "tool_result", "tool_use_id": id, "content": content_message}, {"type": "text", "text": "Please call the next function! If you are finished, call the finished function"}]})
                return messages

            else:
                print("Error, no GPT defined")

        def RequestText(assistant_message):
            '''
            Get function for content from unique LLM response assistant_message
            '''
            if GPT == "Mistral":
                try:
                    return assistant_message.content
                except:
                    print("Error During Reading of Answer")
                    return None

            if GPT == "Gemini":
                try:
                    return assistant_message.content
                except:
                    print("Error During Reading of Answer")
                    return None

            if GPT == "ChatGPT":      
                try:
                    return assistant_message.content
                except:
                    print("Error During Reading of Answer")
                    return None
            
            if GPT == "Anthropic":
                try:
                    return assistant_message[0].text
                except:
                    print("Error During Reading of Answer")
                    return None

        # REQUESTGPT
        # Define functions used to interact with each LLM, depends on the provider. 
        # Note that here, unlike with other function definitions, the "if" condition is placed _before_
        # the definition rather than having it inside
        if GPT == "ChatGPT":
            crash_file_tracker(messages)

            def RequestGPT(messages, tool_call = True, enforce = False):
                response = openai.chat.completions.create(
                    model= OpenAI_model, # GPT 4: gpt-4-0613 GPT 4 Turbo: gpt-4-0125-preview GPT-4o : gpt-4o-2024-05-13 or GPT o3
                    messages=messages,
                    functions=functions,
                    temperature=0.2
                )
                crash_file_tracker(response)
                if debug == True:
                    print("ChatGPT Answer: ")
                    print(response.choices[0].message)
                return response.choices[0].message
                
        if GPT == "Anthropic":
            def RequestGPT(messages, tool_call = True, enforce = False):
                if tool_call:
                    response = client.beta.tools.messages.create(
                        model=model, 
                        max_tokens=4092,
                        messages = messages,
                        tools=functions
                    )
                    print("Anthropic Answer: ")
                    print(response.content)
                    return response.content
                if tool_call == False: #Mal schauen, ob das so funktioniert, oder ob dann immer ein Tool-Call gemacht wird
                    response = client.beta.tools.messages.create(
                        model=model, 
                        max_tokens=4092,
                        messages = messages,
                        tools=functions
                    )
                    print("Anthropic Answer: ")
                    print(response.content)
                    return response.content
                else:
                    response = client.messages.create(
                        max_tokens=1024,
                        messages = messages,
                        model=model,
                    )
                    print("Anthropic Answer: ")
                    print(response.content[0])
                    return response.content[0]
                    
        if GPT == "Mistral":

            def RequestGPT(messages, tool_call = True, enforce = False):
                crash_file_tracker(messages)
                client = MistralClient(api_key=api_key)
                if tool_call:
                    if enforce:
                        tool_choice = "any"
                    else:
                        tool_choice = "auto"
                    response = client.chat(
                        model=model,
                        messages=messages,
                        tools=functions,
                        tool_choice=tool_choice)
                else:
                    response = client.chat(
                        model=model,
                        tools=functions,
                        tool_choice="none",
                        messages=messages)
                    
                if debug == True:
                    print("Mistral Answer: ")
                    print(response.choices[0].message)
                return response.choices[0].message

        if GPT == "Gemini":
            def RequestGPT(messages, tool_call = True, enforce = False):
                #Gemini WRAPPER:
                global Gemini_ChatHistory
                global response
                global last_message
                last_message = toGemini(messages)
                print("User Message: ")
                print(last_message)
                crash_file_tracker(last_message)


                if debug == True:
                    print("Gemini Chat History: ")
                    print(Gemini_ChatHistory)

                if tool_call:
                    tool_config = ToolConfig(
                        function_calling_config=ToolConfig.FunctionCallingConfig(
                            mode=ToolConfig.FunctionCallingConfig.Mode.AUTO
                    ))

                    model = GenerativeModel("gemini-1.5-pro-preview-0409",
                                            tools = [geometry_tool],
                                            tool_config=tool_config,
                                            generation_config={"temperature": 0.2})
                else:
                    tool_config = ToolConfig(
                        function_calling_config=ToolConfig.FunctionCallingConfig(
                            mode=ToolConfig.FunctionCallingConfig.Mode.AUTO
                    ))            
                    model = GenerativeModel("gemini-1.5-pro-preview-0409",
                                            tools = [geometry_tool],
                                            tool_config=tool_config,                                    
                                            generation_config={"temperature": 0.2})
                    
                chat = model.start_chat(history = Gemini_ChatHistory)
                crash_file_tracker(str(Gemini_ChatHistory) + str(last_message))
                response = chat.send_message(last_message)

                Gemini_ChatHistory = chat.history

                print("Gemini Answer: ")
                crash_file_tracker(response.candidates[0].content)
                print(response.candidates[0].content)

                return toChatGPT(response.candidates[0].content)


        # -----------------------*** AGENT FUNCTIONS ***-----------------------
        def Agent1(user_input, instruction, messages, again):
            '''
            This agent enables the LLM to engage in dialogue with the user to solicit additional 
            information if it recognizes that the user prompts might lack clarity or completeness
            -Click functionality is not yet in operation
            -Loop allows the LLM to converse with user until it sends a TERMINATE message
            Args:
            -user_input:
            -messages: expandable log of conversation with LLM
            Return:
            -messages: updated log of conversation with LLM, includes clarifications
            '''

            global text
            #If click mode is activated, add user Click to Info:
            if click:
                click_message = return_click_point()
                complete_message = click_message + user_input
                text.append("[system]" + click_message)
                text.append("[User] " + user_input)
                messages.append({"role":"user","content": complete_message})
                print(complete_message)
            else:
                text.append("[User] " + user_input)
                messages.append({"role":"user","content": user_input})

            # loop to check and ask back
            while True:
                assistant_message = RequestGPT(messages, False)
                # exit if no content
                TextAnswer = RequestText(assistant_message)

                if TextAnswer:
                    messages.append({"role":"assistant","content": TextAnswer})
                    text.append("[GPT]" + TextAnswer)        

                    # terminate conversation
                    if "TERMINATE" in TextAnswer:
                        return messages
                
                    # open window with question for user
                    user_input = rs.EditBox(
                    default_string = "",
                    message = assistant_message.content,
                    title = "RhinoGPT")
                    user_input = input("assistant_message.content")
                
                else:
                    return messages
                
                messages.append({"role":"user","content": user_input})
                text.append("[User] " + user_input)

            return messages

        def Agent2(instruction, messages, completion):
            '''
            This agent instructs the LLM to first generate step-by-step instructions 
            for geometry creation.
            Args:
            -instruction: description of the agent step (generating description of functions the LLM will call)
            -messages: expandable log of conversation with LLM
            Returns:
            -messages: updated log of conversation with LLM, includes description of function calls the LLM will call
            '''
            # Append system message as user Instruction
            user_input = instruction
            messages.append({"role":"user","content": user_input})

            assistant_message = RequestGPT(messages, tool_call = True, enforce = True)

            TextAnswer = RequestText(assistant_message)

            if TextAnswer:
                response = TextAnswer
                text.append("[GPT] " + str(response))
                messages.append({"role":"assistant","content": response})

            return messages

        def Anthropic_Agent3(instruction, messages, completion):

            user_input = instruction
            messages.append({"role": "user", "content": user_input})
            
            if FinishedCalled:
                print("Anthropic Finished already everything in Agent 2! Exiting")
                messages.append({"role":"user","content": "Anthropic Finished already everything in Agent 2! Exiting"})
                return messages

            function_answer = RequestGPT(messages, tool_call=True, enforce=True)

            counter = 0

            while counter < 15:
                counter += 1
                print("--------------------- Function Call Found ---------------------")
                print({"role": "assistant", "content": function_answer})
                messages.append({"role": "assistant","stop_reason": "tool_use", "content": function_answer})
                if FinishedCalled:
                    break
                messages.append({"role":"user","content": "Please call the next Function! If you are finished, call the finished function"})
                function_answer = RequestGPT(messages, tool_call=True, enforce=True)

            completion = True
            return messages                

        def Agent3(instruction, messages, completion):
            '''
            Parses through the messages log, requests the creation of functions when it identifies a function message,
            identifies the function type (finished, createCode, or other) ***does something else I need to properly identify***
            and appends the working function to the message log.
            Args:
            -instruction: description of the agent step (generating description of functions the LLM will call)
            -messages: expandable log of conversation with LLM
            -completion: boolean indicating that stepPlanning step has already taken place; unsure of benefit here
            Returns:
            -messages: updated log of conversation with LLM, includes description of function calls the LLM will call
            ''' 

            # Append system message as user Instruction
            user_input = instruction
            messages.append({"role":"user","content": user_input})

            assistant_message = RequestGPT(messages, tool_call = True, enforce = True)
            crash_file_tracker(assistant_message)        
            # while function call (max Calls = 10)
            counter = 0

            returned_function_call = RequestFunction(assistant_message)

            while counter < 15: #This limit of 15 should be improved and be made case dependent
                counter += 1
                if returned_function_call == None or returned_function_call.name == '':
                    print("no function call was appended!")
                    response = assistant_message
                    messages.append({"role":"assistant","content": response})
                    messages.append({"role":"user","content": "Please call the next function! If you are finished, call the finished function"})
                    assistant_message = RequestGPT(messages, tool_call = True, enforce = True)
                    returned_function_call = RequestFunction(assistant_message)

                function_name = returned_function_call.name
                function_str = returned_function_call.arguments

                try: new_args = json.loads(function_str)
                except: 
                    try: new_args = json_repair.loads(function_str)
                    except:
                        try: 
                            new_args = json_repair.loads(repair_python_to_JSON(function_str))
                            print("final repair attempt successful!")
                        except: new_args = function_str
                
                # Ensure all lists in the arguments have the same length:
                new_args = parse_list(new_args)  #Should only be necessary for ChatGPT 4 and 4o, and not Turbo
                print(new_args)


                print("--------------------- Function Call Found ---------------------")
                print("Function name: ")
                print(function_name)

                if str(function_name) == "finished":
                    messages.append({"role": "assistant", "function_call": {"name": str(function_name), "arguments": str(new_args)}})
                    break

                elif str(function_name) == "CreateCode":
                    print("---------------------- Execute Python Code ----------------------")
                    arguments_dict = new_args
                    python_code = arguments_dict["PythonCode"]
                    try: function_response = create_code(str(python_code))
                    except: function_response = "Unknown Execution Error during Code Creation"
                    answer = "```Python_Code output: " + function_response + "```"
                    print(answer)
                    append_function(assistant_message, answer, new_args)
                    print("Feeding Answer back to ", GPT,"...")
                    assistant_message = RequestGPT(messages, tool_call = True, enforce = True)
                    returned_function_call = RequestFunction(assistant_message)

                else:
                    # get function name and arguments
                    print("calling function:")
                    
                    crash_file_tracker(returned_function_call.arguments)

                    # Path to the JSON file
                    file_path = os.path.join(os.getcwd(), folder, f"{function_name}.json")

                    # Check if the file exists and read existing data; if not, initialize an empty dict
                    if os.path.exists(file_path):
                        with open(file_path, "r") as tf:
                            try:
                                existing_data = json.load(tf)
                                # Ensure existing_data is a dictionary
                                if not isinstance(existing_data, dict):
                                    existing_data = {}
                            except json.JSONDecodeError:  # In case the file is empty or contains invalid JSON
                                existing_data = {}
                    else:
                        existing_data = {}
                    
                    # Merge the new arguments into the existing data
                    for key, value in new_args.items():
                        if key in existing_data:
                            # Assume the value is a list and append the new value(s)
                            if isinstance(value, list):
                                existing_data[key].extend(value)
                            else:
                                # If the existing or new value is not a list, make it a list and append
                                if not isinstance(existing_data[key], list):
                                    existing_data[key] = [existing_data[key]]
                                existing_data[key].append(value)
                        else:
                            # If the key does not exist in the existing data, add it
                            existing_data[key] = value if isinstance(value, list) else [value]
                    
                    # Store the merged data
                    with open(file_path, "w") as tf:
                        json.dump(existing_data, tf)

                    # Add function call to messages

                    append_function(assistant_message, "", new_args)

                    logger(messages, logfile)
                    print({"role": "assistant", "function_call": {"name": str(function_name), "arguments": str(new_args)}})
                        
                    print("Calling for next Function")
                    # Call again (assuming RequestGPT() is defined elsewhere and manages the loop)
                    assistant_message = RequestGPT(messages, tool_call = True, enforce = True)
                    returned_function_call = RequestFunction(assistant_message)                                                                                                                           

            print("Called all Functions")

            # if content -> output to user
            try:
                if assistant_message.content:
                    response = RequestText(assistant_message)
                    if completion:
                        global text
                        text.append("[GPT] " + response)
                    messages.append({"role":"assistant", "content": response})

            except:
                print("No Content in Assistant Message")

            return messages


        # -----------------------*** MAIN PROGRAM ***-----------------------

        if improve:
            running = True
            
            # -----------------------*** START CONTACT WITH LLM API ***-----------------------

            # reset function arguments
            arg_files = glob.glob("temp\*.json")

            for arg_file in arg_files:
                try:
                    os.remove(arg_file)
                except OSError as e:
                    print(f"Error deleting function argument files")

            with open(logfile, "w") as tf:
                json.dump(messages, tf)

            # Load and hand over API key, load function definitions and modify them to structure expected by each provider
            if GPT == "ChatGPT":
                key = open("key.txt", "r")
                api_key = key.read()
                openai.api_key = api_key


                functions = []
                # get provided functions, already in format expected by OpenAI
                for function_name in glob.glob("functions\*.json"):
                    with open(os.path.join(os.getcwd(), function_name), "r") as function:
                        functions.append(json.load(function))

            if GPT == "Anthropic":
                key = open("anthropic_key.txt", "r")
                api_key = key.read()
                client = Anthropic(
                    # This is the default and can be omitted
                    api_key=api_key,
                )
                model = "claude-3-opus-20240229"  # or Expensive: "claude-3-opus-20240229" Fast: "claude-3-haiku-20240307" Intermediate: "claude-3-sonnet-20240229"
                
                functions = []
                # get provided functions, adapt them to format expected by Anthropic
                for function_name in glob.glob("functions/*.json"):
                    with open(os.path.join(os.getcwd(), function_name), "r") as function_file:
                        function_data = json.load(function_file)
                        # Rename 'parameters' key to 'input_schema'
                        if 'parameters' in function_data:
                            function_data['input_schema'] = function_data.pop('parameters')
                        functions.append(function_data)

            if GPT == "Mistral":
                key = open("mistral_key.txt", "r")
                api_key = key.read()
                model = "mistral-large-2402"

                #Function calls are exactly the same as with ChatGPT
                functions = []
                # get provided functions
                for function_name in glob.glob("functions/*.json"): 
                    with open(os.path.join(os.getcwd(), function_name), "r") as function_file:
                        # Load the original function data
                        function_data = json.load(function_file)

                        # Modify the structure as requested
                        modified_function = {
                            "type": "function",
                            "function": function_data
                        }
                        functions.append(modified_function)

            if GPT == "Gemini":
                geometry_tool = create_tool_from_json(directory_path)
                Gemini_ChatHistory = []

            # -----------------------*** DEFINE SYSTEM AND ASK FOR INITIAL USER INPUT ***-----------------------

            # taskfile contains the system and agent workflow descriptions, not the prompt!
            with open(taskfile, "r") as task_file:
                task = json.load(task_file)
            
            logfile_new = os.path.join(response_path, "log.json")
            with open(logfile_new, "r") as log_file:
                messages = json.load(log_file)
            
            


            # -----------------------*** AGENT WORFKLOW PROCESS ***-----------------------
            # Step-by-step process, in which each steps 1, 2, 4 represents an agent workflow:
            #   step1: askBack
            #   step2: stepPlanning
            #   step3: execute prepared function calls and make use of the createCode function if needed
            #   step4: visualInspection, not included in this script
            # The steps within each step are carried out via the Agent1, Agent2, and Agent3 functions.

            # Define next instruction
            instruction = str(task["step3"])
            completion = True

            # Execution
            logger(messages, logfile)
            messages = Agent3(instruction, messages, completion)
            status = "Finished Step 3, program run was succesfully"
            logger(messages, logfile)


            if GPT == "Anthropic":
                print("attempting Sanitization of Subtraction Field")
                try: sanitize_subtraction_field(folder)
                except: print("Sanitization Failed")
                
            destination = copy_files_and_folders(Path(base_destination_path), new_folder_name)
            with open("destination.txt", 'w') as file:
                file.write(destination)

        elif reset:

            # -----------------------*** CLEAR LOG AND CONVERSATION ***-----------------------
            # Used only if go is false and reset is true

            #Clear stdout for logging:
            #sys.stdout = sys.__stdout__

            messages = [{"role": "system", "content": "LOG RESET"}]
            text = []
            text.append("[Prog] New Conversation. Press \"Start\" to begin.")

            # reset function arguments
            arg_files = glob.glob("temp\*.json")

            for arg_file in arg_files:
                try:
                    os.remove(arg_file)
                except OSError as e:
                    print(f"Error deleting function argument files")

            with open(logfile, "w") as tf:
                json.dump(messages, tf)
# ---------- end gpt_improve ----------

path = Panel(directory_path_2)
improved = Panel(panel_7)

panel_9 = Panel(gpt.agent)
visualinspection = Panel(gpt.visualInspection_trigger)
panel_10 = Panel(gpt.gh_terminal_path)

# ---- group: Geometry Creation
create_geometries = Script(path=directory_path_2, change=Button())  # -> out, current_geometry, final_box, new_cylinder, geometry_list, cylinder_list, cylinder_func, a
# ---------- create_geometries: Python ----------
import openai
import os
import json
import sys
import importlib
import rhinoscriptsyntax as rs


path_geometry_module = r"C:\Users\natha\OneDrive\Desktop\OneDrive - ETH Zurich\GitHub\text-to-design-clean\CodeEnvironment"
sys.path.append(path_geometry_module)
print(path)

# Assuming 'path' is defined somewhere above in your script
os.chdir(path)
if path not in sys.path:
    sys.path.append(path)

# Ensure geometry_creation is reloaded to fetch the latest definitions
from geometry_creation import *



folder = "temp"
geometries = ["block", "cylinder"]  # List of geometries to process

current_geometry = None
geometry_list = []
cylinder_list = []
function_args = []
cylinder_func = []

for geometry in geometries:
    function_path = os.path.join(folder, f"{geometry}.json")

    if os.path.exists(function_path):
        with open(function_path, "r") as function:
            function_args = json.load(function)

        if geometry == "block":
            # Initialize missing keys with default values
            default_values = {"x": 0, "y": 0, "z": 0, "subtraction": False}
            for key in default_values:
                if key not in function_args or len(function_args[key]) < len(function_args["x_size"]):
                    function_args[key] = [default_values[key]] * len(function_args["x_size"])

            # Process blocks
            for i in range(len(function_args["x_size"])):
                x = function_args.get("x", [0])[i]
                y = function_args.get("y", [0])[i]
                z = function_args.get("z", [0])[i]
                x_size = function_args["x_size"][i]
                y_size = function_args["y_size"][i]
                z_size = function_args["z_size"][i]
                subtraction = function_args.get("subtraction", [False])[i]
                
                print(f"CreateBox(({x}, {y}, {z}), {x_size}, {y_size}, {z_size})")
                new_box = CreateBox((x, y, z), x_size, y_size, z_size)
                geometry_list.append(new_box)

                if current_geometry is None:
                    current_geometry = new_box
                elif subtraction:
                    current_geometry = rs.BooleanDifference(current_geometry, new_box, False)
                else:
                    print(f"current_geometry: {current_geometry}")
                    print(f"boolean with: {new_box}")
                    try: current_geometry = rs.BooleanUnion((current_geometry, new_box), False)
                    except:
                        print("Boolean Union of Blocks failed")
            final_box = current_geometry
        elif geometry == "cylinder":
            # Process cylinders
            print(function_args)
            n_cyl = len(function_args["baseCenterX"])
            print(f"Number of Cylinders: {n_cyl}")
            print("Cylinder Args:")
            for i in range(len(function_args["baseCenterX"])):
                try:
                    cylinder_func.append(function_args["cylinder_func"][i])  # Attempt to append
                except Exception:
                    pass  # Skip if it fails               
                Start = (function_args["baseCenterX"][i], function_args["baseCenterY"][i], function_args["baseCenterZ"][i])
                End = (function_args["baseCenterX"][i]+function_args["heightVectX"][i], function_args["baseCenterY"][i]+function_args["heightVectY"][i], function_args["baseCenterZ"][i]+function_args["heightVectZ"][i])
                radius = function_args["radius"][i]
                new_cylinder = CreateCylinder(Start, End, radius)
                print(f"Create_cylinder: Start: {Start} End: {End} Radius {radius}" )
                geometry_list.append(new_cylinder)
                cylinder_list.append(new_cylinder)
                if current_geometry is None:
                    current_geometry = new_cylinder
                    
                elif function_args.get("subtraction", [True])[i]:
                    #print(f"Subtraction is set to {function_args.get('subtraction', [False])[i]}, so we subtract the cylinder")
                    try: new_geometry = rs.BooleanDifference(current_geometry, new_cylinder, False)
                    except:
                        new_geometry == []
                    if new_geometry == []:
                        print("Boolean Subtraction Failed! This can happen if Cylinder is completely inside Block or not intersecting at all")
                        
                    else:
                        current_geometry = new_geometry    
                    
                else:
                    print(f"current_geometry: {current_geometry}")
                    print(f"boolean with: {new_cylinder}")
                    bool_parts = (current_geometry, new_cylinder)
                    try: current_geometry = rs.BooleanUnion(bool_parts, False)
                    except:
                        print("Failed to Merge parts")
                        
    else:
        print(f"The file {function_path} does not exist.")


print(f"Final Geometry: {current_geometry}")
print(type(current_geometry))
# ---------- end create_geometries ----------
new_cylinder = Brep(create_geometries.new_cylinder)
final_box = Brep(create_geometries.final_box)
clean_list = CleanList(T=create_geometries.current_geometry)
brep = Brep(clean_list)

# ----
cylinders = Brep(create_geometries.cylinder_list)

# ----
# Brep Cleaning
brep_check = Python3Script(brep=brep)  # -> brep_out; inputs brep: list of Brep
# ---------- brep_check: Python ----------
import Rhino.Geometry as rg
# Ensure input is a list
if not isinstance(brep, list):
    brep_list = [brep]
else:
    brep_list = brep

# Case 1: Only one brep, return it directly
if len(brep_list) == 1:
    brep_out = brep_list[0]

# Case 2: Multiple breps
else:
    # Try to join breps using tolerance of 0.01 units
    joined_breps = rg.Brep.JoinBreps(brep_list, 0.01)

    if joined_breps and len(joined_breps) == 1:
        # Successful join into a single brep
        brep_out = joined_breps[0]
    else:
        # Joining failed – pick the brep with the largest volume
        max_volume = -1
        largest_brep = None
        for b in brep_list:
            props = rg.VolumeMassProperties.Compute(b)
            if props and props.Volume > max_volume:
                max_volume = props.Volume
                largest_brep = b
        brep_out = largest_brep
# ---------- end brep_check ----------
brep_2 = Brep(brep_check)

# ----
# Point-Cloud generation
number_slider = Slider(1000, range=0..4000)
go_3 = BooleanToggle(True)
point_cloud_generation = Python3Script(
    run=allow_evaluation,
    brep_gen=brep_2,
    go=go_3,
    name_input=json_reader.geometry_out,
    model_input=json_reader.model_out,
    agent_input=json_reader.agent_out,
    path_input=directory_path_2,
    num_points=number_slider)  # -> flatten(gen), name, model, agent, path, brep, flatten(gt)
# ---------- point_cloud_generation: Python ----------
if run:
    import Rhino
    import rhinoscriptsyntax as rs
    import numpy as np
    import trimesh
    import os

    # Folder to search for STL files
    base_folder = r"C:\Users\natha\OneDrive\Desktop\OneDrive - ETH Zurich\GitHub\text-to-design-clean\own_benchmark"

    def find_stl_file(folder, name):
        """Find STL file containing 'name' in filename"""
        for file in os.listdir(folder):
            if file.lower().endswith('.stl') and name.lower() in file.lower():
                return os.path.join(folder, file)
        return None

    def load_stl_to_trimesh(stl_path):
        """Load STL file into a Trimesh mesh"""
        mesh = trimesh.load_mesh(stl_path, process=True)
        return mesh

    def brep_to_trimesh(brep):
        """Convert a Rhino Brep (or GUID) to a Trimesh mesh"""
        brep = rs.coercebrep(brep)
        if brep is None:
            return None

        mesh = Rhino.Geometry.Mesh()
        mp = Rhino.Geometry.MeshingParameters.Default
        brep_meshes = Rhino.Geometry.Mesh.CreateFromBrep(brep, mp)
        for m in brep_meshes:
            mesh.Append(m)
        mesh.Normals.ComputeNormals()
        mesh.Compact()

        # Convert to numpy arrays
        vertices = np.array([[v.X, v.Y, v.Z] for v in mesh.Vertices], dtype=np.float32)
        faces = []
        for f in mesh.Faces:
            if f.IsTriangle:
                faces.append([f.A, f.B, f.C])
            elif f.IsQuad:
                faces.append([f.A, f.B, f.C])
                faces.append([f.A, f.C, f.D])
        faces = np.array(faces, dtype=np.int32)

        return trimesh.Trimesh(vertices=vertices, faces=faces, process=True)

    def poisson_sample_trimesh(tri_mesh, num_points, subdivide=True):
        """Sample point cloud from Trimesh with optional subdivision"""
        if subdivide:
            tri_mesh = tri_mesh.subdivide()
        return tri_mesh.sample(num_points)

    def np_to_rhino_points(pts):
        """Convert Nx3 NumPy array to Rhino Point3d objects"""
        return [Rhino.Geometry.Point3d(float(x), float(y), float(z)) for x, y, z in pts]

    # Main logic
    if go and name_input:
        try:
            stl_path = find_stl_file(base_folder, name_input)
            if stl_path:
                mesh = load_stl_to_trimesh(stl_path)
                sampled_pts_np = poisson_sample_trimesh(mesh, int(num_points), subdivide=True)
                sampled_pts = np_to_rhino_points(sampled_pts_np)
            else:
                sampled_pts = []
                print("STL not found:", name_input)
        except Exception as e:
            sampled_pts = []
            print("Error during STL sampling:", str(e))

    if brep_gen:
        tri_mesh = brep_to_trimesh(brep_gen)
        if tri_mesh:
            pc2_np = poisson_sample_trimesh(tri_mesh, int(num_points), subdivide=True)
            pc2 = np_to_rhino_points(pc2_np)
        else:
            pc2 = []

    # Grasshopper output
    gt = sampled_pts
    gen = pc2
    name = name_input
    model = model_input
    agent = agent_input
    path = path_input
    brep = brep_gen
# ---------- end point_cloud_generation ----------

# ----
# CLGD alignment
# CLGD Value
go_4 = BooleanToggle(True)
clgd_alignment = Python3Script(go=go_4, name=point_cloud_generation.name, pts_gen=point_cloud_generation.gen, pts_gt=point_cloud_generation.gt)  # -> flatten(gen), c, name_out, scale, center_gt, R_gt, center_gen, R_out, t_out, flatten(gt); inputs pts_gen: list, pts_gt: list
# ---------- clgd_alignment: Python ----------
import sys
import rhinoscriptsyntax as rs
import Rhino
import numpy as np
import torch
from scipy.spatial.transform import Rotation as R

# Add path to DDF-Loss and LieAlgebra
sys.path.append(r"C:\Users\natha\OneDrive\Desktop\OneDrive - ETH Zurich\GitHub\DDF-Loss")
from loss import CLGD
from LieAlgebra import se3   # se3.exp: (6,) -> (4,4)

device = torch.device("cuda" if torch.cuda.is_available() else "cpu")

# ---------- helper ----------
def rhino_to_np(ptlist):
    if not isinstance(ptlist, list):
        ptlist = [ptlist]
    coords = []
    for guid in ptlist:
        pt = rs.coerce3dpoint(guid)
        if pt:
            coords.append([pt.X, pt.Y, pt.Z])
    return np.array(coords, dtype=np.float32)

def np_to_rhino(array):
    return [Rhino.Geometry.Point3d(float(x), float(y), float(z)) for x, y, z in array]

def normalize_to_unit_cube(pc):
    min_coords = np.min(pc, axis=0)
    max_coords = np.max(pc, axis=0)
    center = (min_coords + max_coords) / 2.0
    scale = np.max(max_coords - min_coords)
    return pc - center, center, scale

def rotate_to_max_x_axis(pc, index):
    if index == 0:
        R_fix = np.eye(3, dtype=np.float32)
    elif index == 1:
        R_fix = np.array([[0, 1, 0], [-1, 0, 0], [0, 0, 1]], dtype=np.float32)
    else:
        R_fix = np.array([[0, 0, 1], [0, 1, 0], [-1, 0, 0]], dtype=np.float32)
    return pc @ R_fix.T, R_fix

def generate_initial_rotations():
    # 24-er Rotationsgruppe des Würfels
    return [r.as_matrix() for r in R.create_group('O')]
# ---------- /helper ----------

# ===== MAIN =====
if go:
    P1_np = rhino_to_np(pts_gt)
    P2_np = rhino_to_np(pts_gen)

    if len(P1_np) == 0 or len(P2_np) == 0:
        aligned_pts, clgd_value = [], 0.0
        R_out, t_out = np.eye(3), np.zeros(3)
    else:
        # ----- Vor-Normalisierung -----
        P1_np, center_gt, scale_gt = normalize_to_unit_cube(P1_np)
        P2_np, center_gen, scale_gen = normalize_to_unit_cube(P2_np)
        scale = max(scale_gt, scale_gen)
        P1_np, P2_np = P1_np / scale, P2_np / scale

        idx_gt = np.argmax(np.max(P1_np, axis=0))
        idx_gen = np.argmax(np.max(P2_np, axis=0))
        P1_np, R_gt = rotate_to_max_x_axis(P1_np, idx_gt)
        P2_np, R_gen = rotate_to_max_x_axis(P2_np, idx_gen)
        ground_truth = np_to_rhino(P1_np)

        # ----- 24 Basis-Rotationen -----
        loss_fn = CLGD(up_ratio=10, K=5, std_factor=3, weighted_query=True, beta=3).to(device)
        P1_t = torch.tensor(P1_np, dtype=torch.float32, device=device).unsqueeze(0)

        best_loss, best_init_rot, best_P2 = float("inf"), None, None
        for R_init in generate_initial_rotations():
            P2_try = P2_np @ R_init.T
            P2_t = torch.tensor(P2_try, dtype=torch.float32, device=device).unsqueeze(0)
            with torch.no_grad():
                loss = loss_fn(P2_t, P1_t).item()
            if loss < best_loss:
                best_loss, best_init_rot, best_P2 = loss, R_init, P2_try

        # ----- SE(3)-Feinoptimierung (50 Iter) -----
        P2_base_t = torch.tensor(best_P2, dtype=torch.float32, device=device).unsqueeze(0)
        pose = torch.zeros(6, dtype=torch.float32, device=device, requires_grad=True)  # se3-Vektor
        opt = torch.optim.Adam([pose], lr=5e-2)

        for _ in range(50):
            opt.zero_grad()
            T = se3.exp(pose)          # (4,4)
            R_opt = T[:3, :3]          # (3,3)
            t_opt = T[:3, 3]           # (3,)
            P2_trans = torch.matmul(P2_base_t, R_opt.t()) + t_opt      # (1,N,3)
            loss = loss_fn(P2_trans, P1_t)
            loss.backward()
            opt.step()

        with torch.no_grad():
            T_opt = se3.exp(pose).cpu().numpy()      # (4,4)
        R_final = T_opt[:3, :3]
        t_final = T_opt[:3, 3]

        aligned_np = (best_P2 @ R_final.T) + t_final
        aligned_pts = np_to_rhino(aligned_np)
        clgd_value = loss.item()

        # ----- Output-Matrizen / Vektoren -----
        R_out = R_final @ best_init_rot @ R_gen       # alles kombiniert
        t_out = t_final                               # im Normalraum

# ===== Grasshopper-Outputs =====
gen          = aligned_pts
name_out     = name
c            = clgd_value
gt           = ground_truth
scale        = scale
center_gt    = center_gt
center_gen   = center_gen
t_out        = t_out
R_out        = R_out
R_gt         = R_gt
# ---------- end clgd_alignment ----------
panel_11 = Panel(clgd_alignment.c)
gen_aligned_original_size = CustomPreview(Geometry=clgd_alignment.gen, Material=ColourSwatch(SwatchColor=RGB(255, 255, 255)))
gt_original_size = CustomPreview(Geometry=clgd_alignment.gt, Material=ColourSwatch(SwatchColor=RGB(40, 218, 255)))
panel_12 = Panel(clgd_alignment.t_out)
panel_13 = Panel(clgd_alignment.R_out)
panel_14 = Panel(clgd_alignment.scale)
panel_15 = Panel(clgd_alignment.center_gen)

# ----
# ICP alignment
go_5 = BooleanToggle(True)
icp_alignment = Python3Script(go=go_5, name=clgd_alignment.name_out, pts_gen=clgd_alignment.gen, pts_gt=clgd_alignment.gt)  # -> flatten(gen), c, name_out, R, t, f, flatten(gt); inputs pts_gen: list, pts_gt: list
# ---------- icp_alignment: Python ----------
if True:
    import sys
    import rhinoscriptsyntax as rs
    import Rhino
    import numpy as np
    import open3d as o3d

    def rhino_to_np(ptlist):
        if not isinstance(ptlist, list):
            ptlist = [ptlist]
        coords = []
        for guid in ptlist:
            pt = rs.coerce3dpoint(guid)
            if pt:
                coords.append([pt.X, pt.Y, pt.Z])
        return np.array(coords, dtype=np.float32)

    def np_to_rhino(array):
        return [Rhino.Geometry.Point3d(float(x), float(y), float(z)) for x, y, z in array]

    def normalize_to_unit_cube(pc):
        min_coords = np.min(pc, axis=0)
        max_coords = np.max(pc, axis=0)
        center = (min_coords + max_coords) / 2.0
        scale = np.max(max_coords - min_coords)
        normalized = (pc - center)
        return normalized, center, scale

    def np_to_o3d(pc_np):
        pcd = o3d.geometry.PointCloud()
        pcd.points = o3d.utility.Vector3dVector(pc_np)
        return pcd

    def o3d_to_np(pcd):
        return np.asarray(pcd.points)

    # Main logic
    if go:
        P1_np = rhino_to_np(pts_gt)
        P2_np = rhino_to_np(pts_gen)

        if len(P1_np) == 0 or len(P2_np) == 0:
            formatted_output = ["Input point cloud is empty"]
            aligned_pts = []
            icp_fitness = 0.0
        else:
            # Normalize
            #P1_np, center_gt, scale_gt = normalize_to_unit_cube(P1_np)
            #P2_np, center_gen, scale_gen = normalize_to_unit_cube(P2_np)

            #if scale_gen > scale_gt:
            #    scale = scale_gen
            #else:
            #    scale = scale_gt            

            #P1_np = P1_np / scale
            #P2_np = P2_np / scale

            norm_gt_pts = np_to_rhino(P1_np)
            norm_gen_pts = np_to_rhino(P2_np)

            # Convert to Open3D format
            source = np_to_o3d(P2_np)
            target = np_to_o3d(P1_np)

            # Estimate normals (not needed for point-to-point ICP, but good practice)
            source.estimate_normals()
            target.estimate_normals()

            threshold = 0.05 # Adjust as needed
            trans_init = np.eye(4)

            reg_p2p = o3d.pipelines.registration.registration_icp(
                source, target, threshold, trans_init,
                o3d.pipelines.registration.TransformationEstimationPointToPoint())
            # Extract transformation matrix
            T_icp = reg_p2p.transformation  # 4x4 matrix

            # Extract rotation matrix (top-left 3x3 block)
            R_icp = T_icp[:3, :3]

            # Extract translation vector (last column of first 3 rows)
            t_icp = T_icp[:3, 3]

            # Transform and unnormalize
            aligned_np = o3d_to_np(source.transform(reg_p2p.transformation))
            #aligned_np = aligned_np * scale  # Keep Gen's scale
            aligned_pts = np_to_rhino(aligned_np)

            # For visualization
            #ground_truth = np_to_rhino(P1_np * scale)
            formatted_output = [f"{i}. {{{pt.X:.6f}, {pt.Y:.6f}, {pt.Z:.6f}}}" for i, pt in enumerate(aligned_pts)]
            icp_fitness = reg_p2p.fitness

    # Grasshopper Outputs
    name_out = name
    gen = aligned_pts          # Output transformed generated point cloud
    c = icp_fitness             # ICP fitness score
    #d = norm_gt_pts            # Normalized GT
    #e = norm_gen_pts           # Normalized Gen
    #f = np_to_rhino(aligned_np / scale)  # Aligned in normalized space
    gt = norm_gt_pts          # Unnormalized GT

    R = R_icp  # 3x3 rotation matrix
    t = t_icp  # 3D translation vector
# ---------- end icp_alignment ----------
aligned_normalized = CustomPreview(Geometry=icp_alignment.f, Material=ColourSwatch(SwatchColor=RGB(187, 92, 255)))
gen_aligned_original_size_2 = CustomPreview(Geometry=icp_alignment.gen, Material=ColourSwatch(SwatchColor=RGB(255, 255, 255)))
gt_original_size_2 = CustomPreview(Geometry=icp_alignment.gt, Material=ColourSwatch(SwatchColor=RGB(40, 218, 255)))
panel_16 = Panel(icp_alignment.R)
panel_17 = Panel(icp_alignment.t)

go_6 = BooleanToggle(True)
brep_normalization = Python3Script(go=go_6, brep=point_cloud_generation.brep, center=clgd_alignment.center_gen, scale=clgd_alignment.scale)  # -> flatten(norm_brep); inputs brep: list
# ---------- brep_normalization: Python ----------
import Rhino
import rhinoscriptsyntax as rs
import numpy as np

def normalize_brep(brep_input, center, scale):
    # Check if 'center' has 3 components (x, y, z)
    if len(center) != 3:
        print("Center must have 3 components: [x, y, z]")
        return None

    # Accept Brep directly from Grasshopper or coerce from GUID
    if isinstance(brep_input, Rhino.Geometry.Brep):
        brep = brep_input
    else:
        brep = rs.coercebrep(brep_input)
    
    if brep is None:
        print("Brep coercion failed")
        return None

    # Convert center to numpy array
    center = np.array(center, dtype=np.float64)
    
    # Perform the translation and scaling transformations
    translation = Rhino.Geometry.Transform.Translation(-center[0], -center[1], -center[2])
    scaling = Rhino.Geometry.Transform.Scale(Rhino.Geometry.Point3d(0, 0, 0), 1.0 / scale)
    transform = scaling * translation

    brep_copy = brep.Duplicate()
    brep_copy.Transform(transform)
    return brep_copy

# Example usage
if go:
    print(type(brep))
    normalized_brep = normalize_brep(brep, center, scale)
else:
    normalized_brep = None

# Output
norm_brep = rs.coercebrep(normalized_brep)
print(type(norm_brep))
# ---------- end brep_normalization ----------
normalized_brep = CustomPreview(Geometry=brep_normalization, Material=ColourSwatch(SwatchColor=RGB(40, 218, 255)))
panel_18 = Panel(brep_normalization)
brep_3 = Brep(brep_normalization)

# ----
# Point-cloud based Evaluation
# Chamfer Distance
allow_run = BooleanToggle(True)
chamfer_distance = Python3Script(run=allow_run, pts_gen=icp_alignment.gen, pts_gt=icp_alignment.gt)  # -> flatten(c); inputs pts_gen: list, pts_gt: list
# ---------- chamfer_distance: Python ----------
import sys
import rhinoscriptsyntax as rs
import Rhino
import numpy as np

def rhino_to_np(ptlist):
    if not isinstance(ptlist, list):
        ptlist = [ptlist]
    coords = []
    for guid in ptlist:
        pt = rs.coerce3dpoint(guid)
        if pt:
            coords.append([pt.X, pt.Y, pt.Z])
    return np.array(coords, dtype=np.float32)

# Chamfer Distance calculation
def chamfer_distance(P1, P2):
    dist_1_to_2 = np.mean(np.min(np.linalg.norm(P1[:, np.newaxis] - P2, axis=2), axis=1))
    dist_2_to_1 = np.mean(np.min(np.linalg.norm(P2[:, np.newaxis] - P1, axis=2), axis=1))
    return (dist_1_to_2 + dist_2_to_1)*0.5

if run:
    gt_np = rhino_to_np(pts_gt)
    gen_np = rhino_to_np(pts_gen)

    if len(gt_np) == 0 or len(gen_np) == 0:
        chamfer_value = 0.0
    else:
        chamfer_value = chamfer_distance(gt_np, gen_np)
else:
    chamfer_value = 100


c = chamfer_value
print(c)
# ---------- end chamfer_distance ----------
chamfer_distance_2 = Panel(chamfer_distance)

# ----
# CLGD value
allow_run_2 = BooleanToggle(True)
go_7 = BooleanToggle(True)
clgd_value = Python3Script(run=allow_run_2, go=go_7, pts_gt=icp_alignment.gt, pts_gen=icp_alignment.gen)  # -> flatten(clgd); inputs pts_gt: list, pts_gen: list
# ---------- clgd_value: Python ----------
if run:
    import sys
    import rhinoscriptsyntax as rs
    import Rhino
    import numpy as np
    import torch

    # Add path to DDF-Loss repo
    sys.path.append(r"C:\Users\natha\OneDrive\Desktop\OneDrive - ETH Zurich\GitHub\DDF-Loss")

    from loss import CLGD

    device = torch.device("cuda" if torch.cuda.is_available() else "cpu")

    def rhino_to_np(ptlist):
        if not isinstance(ptlist, list):
            ptlist = [ptlist]
        coords = []
        for guid in ptlist:
            pt = rs.coerce3dpoint(guid)
            if pt:
                coords.append([pt.X, pt.Y, pt.Z])
        return np.array(coords, dtype=np.float32)

    # Grasshopper inputs: pts_gt, pts_gen, go

    if go:
        gt_np = rhino_to_np(pts_gt)
        gen_np = rhino_to_np(pts_gen)

        if len(gt_np) == 0 or len(gen_np) == 0:
            clgd_value = 0.0
        else:
            P1 = torch.tensor(gt_np, dtype=torch.float32, device=device).unsqueeze(0)
            P2 = torch.tensor(gen_np, dtype=torch.float32, device=device).unsqueeze(0)

            loss_fn = CLGD(up_ratio=10, K=5, std_factor=3, weighted_query=True, beta=3).to(device)
            clgd_value = loss_fn(P2, P1).item()
    else:
        clgd_value = 100

    # Set the output for Grasshopper
    clgd = clgd_value  # This makes the clgd value accessible in Grasshopper output
    print(clgd)
# ---------- end clgd_value ----------
clgd_value_2 = Panel(clgd_value)

# ----
# Hausdorff Distance
go_8 = BooleanToggle(True)
hausdorff_distance = Python3Script(go=go_8, pts_gen=icp_alignment.gen, pts_gt=icp_alignment.gt)  # -> c; inputs pts_gen: list, pts_gt: list
# ---------- hausdorff_distance: Python ----------
import sys
import rhinoscriptsyntax as rs
import Rhino
import numpy as np

def rhino_to_np(ptlist):
    """Convert Rhino Point3d GUIDs to Nx3 NumPy array."""
    coords = []
    for guid in ptlist:
        pt = rs.coerce3dpoint(guid)
        if pt:
            coords.append([pt.X, pt.Y, pt.Z])
    return np.array(coords, dtype=np.float32)

def hausdorff_distance(P1, P2):
    """Calculate the Hausdorff distance between two point clouds."""
    dist_1_to_2 = np.max(np.min(np.linalg.norm(P1[:, np.newaxis] - P2, axis=2), axis=1))
    dist_2_to_1 = np.max(np.min(np.linalg.norm(P2[:, np.newaxis] - P1, axis=2), axis=1))
    return max(dist_1_to_2, dist_2_to_1)

if go:
    # Convert Rhino point clouds to NumPy arrays
    gt_np = rhino_to_np(pts_gt)
    gen_np = rhino_to_np(pts_gen)

    if len(gt_np) == 0 or len(gen_np) == 0:
        hausdorff_value = 0.0
    else:
        hausdorff_value = hausdorff_distance(gt_np, gen_np)
else:
    hausdorff_value = 100  # Placeholder value for no execution

# Grasshopper output
c = hausdorff_value
print(c)
# ---------- end hausdorff_distance ----------
hausdorff_distance_2 = Panel(hausdorff_distance)

# ----
# ICP Fitness threshold = 0.05
panel_19 = Panel(icp_alignment.c)

# ----
# Apply Rigid-Motion to Brep
go_9 = BooleanToggle(True)
translation_t1 = Python3Script(go=go_9, brep=brep_3, t1=clgd_alignment.t_out)  # -> a; inputs brep: list
# ---------- translation_t1: Python ----------
import Rhino
import rhinoscriptsyntax as rs
import numpy as np

def translate_brep(brep_input, t1):
    brep = rs.coercebrep(brep_input)
    if not brep:
        print("Brep coercion failed")
        return None

    t1 = np.array(t1, dtype=np.float64).flatten().tolist()
    

    total_translation = [t1[0], t1[1], t1[2]]
    translation = Rhino.Geometry.Transform.Translation(*total_translation)

    brep_copy = brep.Duplicate()
    brep_copy.Transform(translation)

    return brep_copy

if go:
    new_brep = translate_brep(brep, t1)


a = new_brep
# ---------- end translation_t1 ----------
go_10 = BooleanToggle(True)
brep_4 = Brep(translation_t1)
rotation_r1 = Python3Script(go=go_10, brep=brep_4, R1=clgd_alignment.R_out)  # -> a; inputs brep: list
# ---------- rotation_r1: Python ----------
import Rhino
import rhinoscriptsyntax as rs
import numpy as np

def rotate_brep(brep_input, R1):
    brep = rs.coercebrep(brep_input)
 
    brep_copy = brep.Duplicate()

    R1 = np.array(R1, dtype=np.float64)
    
    # Build Rhino Transform from numpy R
    def numpy_to_transform(R):
        T = Rhino.Geometry.Transform.Identity
        T.M00 = R[0,0]; T.M01 = R[0,1]; T.M02 = R[0,2]; T.M03 = 0.0
        T.M10 = R[1,0]; T.M11 = R[1,1]; T.M12 = R[1,2]; T.M13 = 0.0
        T.M20 = R[2,0]; T.M21 = R[2,1]; T.M22 = R[2,2]; T.M23 = 0.0
        T.M30 = 0.0;    T.M31 = 0.0;    T.M32 = 0.0;    T.M33 = 1.0
        return T

    # Apply R1
    transform1 = numpy_to_transform(R1)
    brep_copy.Transform(transform1)

    return brep_copy


# Execution
if go:
    new_brep = rotate_brep(brep, R1)
else:
    new_brep = brep  # output untransformed Brep if go is False

# Output
a = new_brep
print(type(a))
# ---------- end rotation_r1 ----------
go_11 = BooleanToggle(True)
brep_5 = Brep(rotation_r1)
translation_t2 = Python3Script(go=go_11, brep=brep_5, t2=icp_alignment.t)  # -> a; inputs brep: list
# ---------- translation_t2: Python ----------
import Rhino
import rhinoscriptsyntax as rs
import numpy as np

def translate_brep(brep_input, t2):
    brep = rs.coercebrep(brep_input)
    if not brep:
        print("Brep coercion failed")
        return None

    
    t2 = np.array(t2, dtype=np.float64).flatten().tolist()

    total_translation = [t2[0], t2[1], t2[2]]
    translation = Rhino.Geometry.Transform.Translation(*total_translation)

    brep_copy = brep.Duplicate()
    brep_copy.Transform(translation)

    return brep_copy

if go:
    new_brep = translate_brep(brep, t2)


a = new_brep
# ---------- end translation_t2 ----------
go_12 = BooleanToggle(True)
brep_6 = Brep(translation_t2)
rotation_r2 = Python3Script(go=go_12, brep=brep_6, R2=icp_alignment.R)  # -> a; inputs brep: list
# ---------- rotation_r2: Python ----------
import Rhino
import rhinoscriptsyntax as rs
import numpy as np

def rotate_brep(brep_input, R2):
    brep = rs.coercebrep(brep_input)
 
    brep_copy = brep.Duplicate()

    
    R2 = np.array(R2, dtype=np.float64)

    # Build Rhino Transform from numpy R
    def numpy_to_transform(R):
        T = Rhino.Geometry.Transform.Identity
        T.M00 = R[0,0]; T.M01 = R[0,1]; T.M02 = R[0,2]; T.M03 = 0.0
        T.M10 = R[1,0]; T.M11 = R[1,1]; T.M12 = R[1,2]; T.M13 = 0.0
        T.M20 = R[2,0]; T.M21 = R[2,1]; T.M22 = R[2,2]; T.M23 = 0.0
        T.M30 = 0.0;    T.M31 = 0.0;    T.M32 = 0.0;    T.M33 = 1.0
        return T

    # Apply R2
    transform2 = numpy_to_transform(R2)
    brep_copy.Transform(transform2)

    return brep_copy


# Execution
if go:
    new_brep = rotate_brep(brep, R2)
else:
    new_brep = brep  # output untransformed Brep if go is False

# Output
a = new_brep
print(type(a))
# ---------- end rotation_r2 ----------
mesh = Mesh(rotation_r2)

# ----
# STL-to-Mesh (normalized)
allow_run_3 = BooleanToggle(True)
go_13 = BooleanToggle(True)
stltomesh = Python3Script(
    run=allow_run_3,
    go=go_13,
    name_input=icp_alignment.name_out,
    center=clgd_alignment.center_gt,
    scale=clgd_alignment.scale,
    R_gt=clgd_alignment.R_gt)  # -> a, b
# ---------- stltomesh: Python ----------
if run:
    import Rhino
    import numpy as np
    import open3d as o3d
    import trimesh
    import os
    import Rhino.Geometry as rg

    # Folder to search for STL files
    base_folder = r"C:\Users\natha\OneDrive\Desktop\OneDrive - ETH Zurich\GitHub\text-to-design-clean\own_benchmark"

    def find_stl_file(folder, name):
        """Find STL file containing 'name' in filename"""
        for file in os.listdir(folder):
            if file.lower().endswith('.stl') and name.lower() in file.lower():
                return os.path.join(folder, file)
        return None

    def load_stl_to_o3d(stl_path):
        """Load STL file into Open3D TriangleMesh"""
        mesh_tm = trimesh.load_mesh(stl_path)
        mesh_o3d = o3d.geometry.TriangleMesh(
            vertices=o3d.utility.Vector3dVector(mesh_tm.vertices),
            triangles=o3d.utility.Vector3iVector(mesh_tm.faces)
        )
        mesh_o3d.compute_vertex_normals()
        return mesh_o3d
    
    #normalization
    def normalize_gt_mesh(o3d_mesh_gt, center_gt, scale):
    
        verts = np.asarray(o3d_mesh_gt.vertices)

        verts = (verts - center_gt) / scale

        o3d_mesh_gt.vertices = o3d.utility.Vector3dVector(verts)
        o3d_mesh_gt.compute_vertex_normals()

        return o3d_mesh_gt
    

    #for preview
    def o3d_mesh_to_rhino_mesh(o3d_mesh):
        rh_mesh = rg.Mesh()
        verts = np.asarray(o3d_mesh.vertices)
        faces = np.asarray(o3d_mesh.triangles)
        
        for v in verts:
            rh_mesh.Vertices.Add(rg.Point3d(*v))
        
        for f in faces:
            rh_mesh.Faces.AddFace(int(f[0]), int(f[1]), int(f[2]))
        
        rh_mesh.Normals.ComputeNormals()
        rh_mesh.Compact()
        
        return rh_mesh



    # Main logic
    if go:
            stl_path = find_stl_file(base_folder, name_input)
            if stl_path:
                mesh = load_stl_to_o3d(stl_path)
                norm_mesh = normalize_gt_mesh(mesh, center, scale)
            
                # Apply rotation R_gt
                verts = np.asarray(norm_mesh.vertices)
                verts_rotated = verts @ R_gt.T  # Apply R_gt to each vertex
                norm_mesh.vertices = o3d.utility.Vector3dVector(verts_rotated)
                norm_mesh.compute_vertex_normals()

            else:
                mesh = None
                print("STL not found:", name_input)
    
    
    a = norm_mesh
    b = o3d_mesh_to_rhino_mesh(a)
    print(type(b))
# ---------- end stltomesh ----------
mesh_2 = Mesh(stltomesh.b)

mesh_optimization = Python3Script(go=Toggle(True), gen_mesh=mesh, gt_mesh=mesh_2)  # -> a, b, aligned_mesh, gt_mesh_out; inputs gen_mesh: Mesh, gt_mesh: Mesh
# ---------- mesh_optimization: Python ----------
import trimesh
import numpy as np
from scipy.spatial.transform import Rotation as R
from scipy.optimize import minimize
import Rhino.Geometry as rg

def rhino_mesh_to_trimesh(mesh):
    """Convert Rhino.Geometry.Mesh to trimesh.Trimesh"""
    V = np.array([[v.X, v.Y, v.Z] for v in mesh.Vertices])
    F = []
    for f in mesh.Faces:
        if f.IsTriangle:
            F.append([f.A, f.B, f.C])
        elif f.IsQuad:
            F.append([f.A, f.B, f.C])
            F.append([f.A, f.C, f.D])
    F = np.array(F)
    return trimesh.Trimesh(vertices=V, faces=F, process=True)

def trimesh_to_rhino_mesh(tm):
    """Convert trimesh.Trimesh to Rhino.Geometry.Mesh"""
    rmesh = rg.Mesh()
    for v in tm.vertices:
        rmesh.Vertices.Add(*v)
    for f in tm.faces:
        if len(f) == 3:
            rmesh.Faces.AddFace(int(f[0]), int(f[1]), int(f[2]))
        elif len(f) == 4:
            rmesh.Faces.AddFace(int(f[0]), int(f[1]), int(f[2]), int(f[3]))
    rmesh.Normals.ComputeNormals()
    rmesh.Compact()
    return rmesh


def compute_iou_iogt(meshA, meshB):
    """Compute IoU and IoGT from trimesh meshes"""
    if not meshA.is_watertight or not meshB.is_watertight:
        return 0.0, 0.0, "Warning: One or both meshes are not watertight."

    try:
        intersection = meshA.intersection(meshB)
        union = meshA.union(meshB)

        vol_intersection = intersection.volume
        vol_union = union.volume
        vol_gt = meshA.volume

        iou = vol_intersection / vol_union if vol_union > 0 else 0.0
        iogt = vol_intersection / vol_gt if vol_gt > 0 else 0.0

        return iou, iogt, "Success"
    except Exception as e:
        return 0.0, 0.0, f"Boolean operation failed: {str(e)}"

def apply_se3(mesh, params):
    """Apply SE(3) transformation to a mesh: [rx, ry, rz, tx, ty, tz]"""
    mesh = mesh.copy()
    rotation = R.from_euler('xyz', params[:3]).as_matrix()
    transform = np.eye(4)
    transform[:3, :3] = rotation
    transform[:3, 3] = params[3:]
    mesh.apply_transform(transform)
    return mesh

def objective_iou(params, mesh_gen, mesh_gt):
    """Objective to minimize = -IoU"""
    try:
        transformed = apply_se3(mesh_gen, params)
        iou, _, _ = compute_iou_iogt(mesh_gt, transformed)
        return -iou  # maximize IoU
    except:
        return 1.0  # bad value if something goes wrong

# Run on trigger
if go:
    # Convert Rhino meshes to trimesh
    tm_gt = rhino_mesh_to_trimesh(gt_mesh)
    tm_gen = rhino_mesh_to_trimesh(gen_mesh)

    # Initial guess: no rotation or translation
    x0 = np.zeros(6)

    # Optimize SE(3) transform
    result = minimize(objective_iou, x0, args=(tm_gen, tm_gt), method='Powell', options={'maxiter': 100})

    # Apply transformation
    tm_gen_aligned = apply_se3(tm_gen, result.x)

    # Compute IoU and IoGT
    iou, iogt, status = compute_iou_iogt(tm_gt, tm_gen_aligned)

    # Convert to Rhino meshes for output
    a = iou
    b = iogt
    aligned_mesh = trimesh_to_rhino_mesh(tm_gen_aligned)
    gt_mesh_out = trimesh_to_rhino_mesh(tm_gt)
# ---------- end mesh_optimization ----------
mesh_3 = Mesh(mesh_optimization.aligned_mesh)
mesh_4 = Mesh(mesh_optimization.gt_mesh_out)
iou = Panel(mesh_optimization.a)
rotated_brep = CustomPreview(Geometry=mesh_4, Material=ColourSwatch(SwatchColor=RGB(0, 0, 57)))
iogt = Panel(mesh_optimization.b)

panel_20 = Panel(clgd_alignment.R_gt)
save = Python3Script(
    go=button,
    name=point_cloud_generation.name,
    CD=chamfer_distance_2,
    CLGD=clgd_value_2,
    HD=hausdorff_distance_2,
    ICP=panel_19,
    IoU=mesh_optimization.a,
    IoGT=mesh_optimization.b,
    trigger_visualInspection=gpt_check.improve,
    response=gpt_check.a,
    model=point_cloud_generation.model,
    AgentMode=point_cloud_generation.agent,
    input_path=point_cloud_generation.path)
# ---------- save: Python ----------
import os
import csv
from datetime import datetime

if go:
    # Folder path where the results are stored
    folder_path = r"C:\Users\natha\OneDrive\Desktop\OneDrive - ETH Zurich\GitHub\text-to-design-clean\Evaluation"
    csv_filename = 'results_testing_phase.csv'
    file_path = f"{folder_path}\\{csv_filename}"


    csv_filename2 = 'visual_trigger_phase01.csv'
    file_path2 = f"{folder_path}\\{csv_filename2}"

    # Extract TestPrompt_Nr from the input path
    test_prompt_nr = input_path.split('_')[-1]  # Get the number after 'TestPrompts_'

    # Ensure the folder exists
    if not os.path.exists(folder_path):
        os.makedirs(folder_path)


    # Get current time in a readable format
    current_time = datetime.now().strftime('%Y-%m-%d %H:%M:%S')

    # Prepare the data
    data = [
        name,  # Object name
        test_prompt_nr,  # TestPrompt Nr
        AgentMode,
        float(CLGD),
        float(CD),
        float(HD),
        ICP,
        IoU,
        IoGT,
        current_time,  # Timestamp
    ]
    data2 = [
        name,
        test_prompt_nr,
        trigger_visualInspection,
        response
    ]

    # Write to CSV
    with open(file_path, mode='a', newline='') as file:  # Open in append mode ('a')
        writer = csv.writer(file)
        # If the file is empty, write the header first
        if file.tell() == 0:
            writer.writerow(['Object Name', 'TestPrompt Nr', 'AgentMode', 'CLGD', 'Chamfer Distance', 'Hausdorff Distance', 'ICP Threshold', 'IoU', 'IoGT', 'Timestamp'])  # Write headers
        writer.writerow(data)  # Write the current data
    
    
    if AgentMode == "visualInspection":
        with open(file_path2, mode = 'a', newline = '') as file:
            writer = csv.writer(file)
            if file.tell() == 0:
                writer.writerow(['Object Name' , 'TestPrompt Nr' , 'Improved' , 'Feedback'])
            writer.writerow(data2)
# ---------- end save ----------
pic = Python3Script(brep=point_cloud_generation.brep, input_path=point_cloud_generation.path, capture=button)  # inputs brep: Brep
# ---------- pic: Python ----------
import rhinoscriptsyntax as rs
import scriptcontext as sc
import Rhino
import System.Drawing
import System.Drawing.Imaging as Imaging

folder_path = r"C:\Users\natha\OneDrive\Desktop\OneDrive - ETH Zurich\GitHub\text-to-design-clean\Evaluation\pictures"

def zoom_view_to_brep(brep_id, padding=1.1):
    obj = sc.doc.Objects.Find(brep_id)
    bbox = obj.Geometry.GetBoundingBox(True)

    # Expand bounding box
    center = bbox.Center
    min_pt = bbox.Min
    max_pt = bbox.Max
    vec = max_pt - min_pt
    min_pt -= vec * ((padding - 1.0) / 2.0)
    max_pt += vec * ((padding - 1.0) / 2.0)
    expanded_box = Rhino.Geometry.BoundingBox(min_pt, max_pt)

    # Apply zoom
    view = sc.doc.Views.ActiveView
    view.ActiveViewport.ZoomBoundingBox(expanded_box)
    view.Redraw()

if capture and brep:
    # Add Brep temporarily to Rhino document
    brep_id = sc.doc.Objects.AddBrep(brep)

    if brep_id:
        # Smart zoom to Brep
        zoom_view_to_brep(brep_id)

        # Filename
        try:
            test_prompt_nr = input_path.split("_")[-1]
        except:
            test_prompt_nr = "capture"

        
        filename = f"{test_prompt_nr}.png"
        file_path = f"{folder_path}\\{filename}"

        # View and size
        view = sc.doc.Views.ActiveView
        size = System.Drawing.Size(1500, 1500)

        vc = Rhino.Display.ViewCapture()
        vc.Width = size.Width
        vc.Height = size.Height
        vc.ScaleScreenItems = False
        vc.TransparentBackground = False
        vc.View = view

        bitmap = vc.CaptureToBitmap(view)
        if bitmap:
            bitmap.Save(file_path, Imaging.ImageFormat.Png)

        # Delete temporary Brep
        sc.doc.Objects.Delete(brep_id, True)
# ---------- end pic ----------
# ----
# STL saving
combine = Python3Script(x=directory_path_2)  # -> a
# ---------- combine: Python ----------
a = x + '\Part.stl'
# ---------- end combine ----------
mesh_5 = Mesh(brep_2)
panel_21 = Panel(combine)
export_stl = ExportSTL(Mesh=mesh_5, Relocate=True, SavePath=combine, SaveAsBinaryFile=True, SaveNow=button, LastSaveLocalization="neutral,N")

# ==== cluster InteractionHistory
text = ClusterInput()
panel = Panel(text)
text_join = TextJoin(Text=text)
read_file = ReadFile(File=text_join, PerLineParse=True)
content = ClusterOutput(read_file)
panel_2 = Panel(read_file)
panel_3 = Panel(text_join)

# ==== cluster CleanList: Remove empty list elements and flatten tree
T = ClusterInput()
clean = CleanTree(RemoveNulls=True, RemoveInvalid=True, RemoveEmpty=False, Tree=T)
flatten = FlattenTree(Tree=clean, Path="{0}")
T_2 = ClusterOutput(flatten)
